# Grasshopper definition Rhino_Grasshopper_Graph Pathfinding_startingsmall.gh (Grasshopper 1.0.7)
# plug-ins: Human, GH_CPython

nheight = Slider(5, range=0..200)
# Pathfinding starting small
# Input
nrow = Slider(6, range=0..200)
ncol = Slider(6, range=0..200)

# ---- group: NetworkX (script)
# Process
gh_cpython = GH_CPython(nrow=nrow, ncol=ncol, nheight=nheight)  # -> path, Mid, Ed, Bol, pathlength; inputs nrow: list, ncol: list, nheight: list
# ---------- gh_cpython: Python ----------
import sys
import csv
import networkx as nx
from numpy import array, zeros, float64, sqrt

PathCSV = "C:\\Users\\mivanesch\\Documents\\bouwkunde minor\\Q2 Spatial Computing design\\wk4\\Exceltabellen.relatie.spaces\\Pathfinding_gebouw.csv"
with open(PathCSV, 'rt') as csvfile:
    reader = csv.reader(csvfile, delimiter='\t', quotechar='|')
    gebouwdata = [row for row in reader]
    print gebouwdata
    gebouw = [(float(row[0]), float(row[1]), float(row[2])) for row in gebouwdata[1:]]

PathCSV = "C:\\Users\\mivanesch\\Documents\\bouwkunde minor\\Q2 Spatial Computing design\\wk4\\Exceltabellen.relatie.spaces\\Pathfinding_bollen.csv"
with open(PathCSV, 'rt') as csvfile:
    reader = csv.reader(csvfile, delimiter='\t', quotechar='|')
    bollendata = [row for row in reader]
    print bollendata
    bollen = [(float(row[1]), float(row[2]), float(row[3])) for row in bollendata[1:]]

PathCSV = "C:\\Users\\mivanesch\\Documents\\bouwkunde minor\\Q2 Spatial Computing design\\wk4\\Exceltabellen.relatie.spaces\\Pathfinding_paden.csv"
with open(PathCSV, 'rt') as csvfile:
    reader = csv.reader(csvfile, delimiter=',', quotechar='|')
    padendata = [row for row in reader]
    print padendata
    paden = [(int(row[1]), int(row[2])) for row in padendata[1:]]

### creating the voxelgrid 

G = nx.Graph()

#input of voxelgrid of the shape of the building. 

#input points to travel over (pointcloud)

#nrow = 4
#ncol = 5
#ndepth = 2

#define distance of matrixgrid

dx = (gebouw[1][0]-gebouw[0][0])/(ncol-1)
dy = (gebouw[1][1]-gebouw[0][1])/(nrow-1)
dz = (gebouw[1][2]-gebouw[0][2])/(nheight-1)

n = nrow*ncol*nheight

#defining midpoints of nodes
mid = zeros((n, 3), dtype=float64)
k = 0
for l in range(nheight):
    for i in range(nrow):
        for j in range(ncol):     
            mid[k][0] = gebouw[0][0]+j*dx
            mid[k][1] = gebouw[0][1]+i*dy
            mid[k][2] = gebouw[0][2]+l*dz
            k += 1
print mid

nvoxel = nrow*ncol*nheight
nbollen = len(bollen)
bolvoxel = zeros((nbollen), dtype=int)
for i in range(nbollen):
    mindist = 9e99
    for j in range(nvoxel):
        dist = 0.0
        for k in range(3):
            dist += (bollen[i][k]-mid[j][k])*(bollen[i][k]-mid[j][k])
        if (dist < mindist):
            bolvoxel[i] = j
            mindist = dist

print 'bolllen'
print bolvoxel

G.clear()
G = nx.Graph()
for k in range(n):
    G.add_node(k)
k = 0

#defining edges to travel over
for l in range(nheight):
    for i in range(nrow):
        for j in range(ncol):   
            if j < ncol-1:
                G.add_edge(k,k+1)
            if i < nrow-1:
                G.add_edge(k,k+ncol)
            if l < nheight-1:
                G.add_edge(k,k+(ncol*nrow))
            k += 1

#defining the edges and weight of the edges
ed = zeros((G.number_of_edges(), 2), dtype=int)

#for i in range(G.number_of_edges()):
i = 0
for (u, v, wt) in G.edges.data():
    ed[i][0] = u
    ed[i][1] = v
    i += 1

#wt is weight



###shortest path way 1
#shortest path in nodes
sp = dict(nx.all_pairs_shortest_path(G))
#print 'shortest in G van %d naar %d: ' % (start, end)

#shortest path in all nodes to ends
splength = dict(nx.all_pairs_shortest_path_length(G))
#print splength

#for mid in (start, end)
#print 'shortest nodepath in G van %d naar %d: ' % (start, end)    


#creating shortest path in nodes
#path.append = sp[start][end]

#list
path = []
start = bolvoxel[0]
end = bolvoxel[1]
path.append(sp[start][end])
start = bolvoxel[2]
end = bolvoxel[3]
path.append(sp[start][end])

pathlength = []
start = bolvoxel[0]
end = bolvoxel[1]
pathlength.append(splength[start][end])
start = bolvoxel[2]
end = bolvoxel[3]
pathlength.append(splength[start][end])







#translating to string for python geometry component
#mid all the nodes
#ed all the edges
Mid = [(str(item[0])+"%"+str(item[1])+"%"+str(item[2])) for item in mid]
Ed = [(str(item[0])+"%"+str(item[1])) for item in ed]
Bol = [(str(item[0])+"%"+str(item[1])+"%"+str(item[2])) for item in bollen]
Path = [(str(item[0])+"%"+str(item[1])) for item in ed]
#print Mid
#print Ed

print 'hallo'
#print Bol
print gebouw
print bollen
print paden
# ---------- end gh_cpython ----------

# ---- group: shortest path along nodes visualisation to rhino geometry
ghpython_script = GhPythonScript(path=gh_cpython.path, Mid=gh_cpython.Mid, Ed=gh_cpython.Ed, Bol=gh_cpython.Bol, pathlength=gh_cpython.pathlength)  # -> points, lines, pathpoints, pathlines, locations; inputs path: list, Mid: list, Ed: list, Bol: list, pathlength: list
# ---------- ghpython_script: Python ----------
import Rhino.Geometry as rg
from math import sqrt

points = []
lines = []
pathpoints = []
pathlines = []
locations=[]
lengths = []

#print Mid
#print Ed

#reading in strings and converting to datatype
#print Mid

for i in xrange(len(Mid)):
    point = Mid[i].replace(" ",'')
    point = point[1:-1].split('%')
    point = [float(j) for j in point]
    #creating point3d for nodepoints
    point = rg.Point3d(point[0],point[1],point[2])
    points.append(point)

#locations
print Bol

for i in xrange(len(Bol)):
    print Bol[i]
    location = Bol[i].replace(" ",'')
    location = location[1:-1].split('%')
    location = [float(j) for j in location]
    #creating point3d for nodepoints
    location = rg.Point3d(location[0],location[1],location[2])
    locations.append(location)

#creating shortestpathnodes from nodepoints
for i in xrange(len(path)):
    pathpoint = path[i].replace(" ",'')
    print pathpoint
    pathpoint= rg.Point3d(points[int(pathpoint)])
    print pathpoint
    pathpoints.append(pathpoint)

for i in xrange(len(pathlength)):
    length = pathlength[i].replace(" ",'')
    lengths.append((int)(length))

#creating lines for edges
for i in xrange(len(Ed)):
    line = Ed[i].replace(" ",'')
    line = line[1:-1].split('%')
    line = [int(j) for j in line]
    line = rg.Line(points[line[0]], points[line[1]])
    lines.append(line)
    
#creating lines for path
k = 0
for j in xrange(len(lengths)):
    
    print lengths[j]
    for i in xrange(lengths[j]):
        pathline = rg.Line(pathpoints[k], pathpoints[k+1])
        pathlines.append(pathline)
        k = k+1
    k = k+1
    
#creating lines for path
#for i in xrange(len(pathpoints-1)):
#    line = Ed[i].replace(" ",'')
#    line = line[1:-1].split('%')
 
#    line = [int(j) for j in line]
#    line = rg.Line(pathpoints[line[0]], pathpoints[line[1]])
#    linespath.append(line)

#creating shortestpathlines from nodepoints
#for i in xrange(len(path)):
#    pathline = path[i].replace(" ",'')
#    print pathline
#    pathline= rg.Line(pathpoints[lines[0]], pathpoints[lines[1]])
#    print pathpoint
#    pathlines.append(pathline)
# ---------- end ghpython_script ----------

# ---- group: lines of path
line = Line(ghpython_script.pathlines)

# ---- group: points of path
point = Point(ghpython_script.pathpoints)

# ---- group: start and end points
point_2 = Point(ghpython_script.locations)

# ---- group: lines of grid
line_2 = Line(ghpython_script.lines)

# ---- group: points of grid
# Output
point_3 = Point(ghpython_script.points)

# ---- group: visualisation of shortestpath nodes (&nodes&edges)
number_slider = Slider(10, range=0..10)
colour_swatch = ColourSwatch(SwatchColor=RGB(255, 158, 158))
dot_display = DotDisplay(Point=point_3, Colour=ColourSwatch(SwatchColor=RGB(255, 0, 0)), Size=Slider(0.25, range=0..1))
point_list = PointList(Points=point_3, Size=Slider(0.25, range=0..10))
dot_display_2 = DotDisplay(Point=point_2, Colour=ColourSwatch(SwatchColor=RGB(255, 0, 0)), Size=Slider(0.527, range=0..1))

# ----
custom_preview_lineweights = CustomPreviewLineweights(Geometry=line, Shader=colour_swatch, Thickness=number_slider, Absolute=False)
