# Grasshopper definition PointCuller.gh (Grasshopper 1.0.7)

mesh = Mesh([<mesh referenced from the Rhino model> x5000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])
volume = Volume(Geometry=mesh)  # -> Volume, Centroid
pt = Point(volume.Centroid)

# ----
# INPUT
panel = Panel("Input Solar Envelope")

# ----
# Computation
# (deletes points with less than 3 neighbours)
# Computation
# (deletes points with less than 3 neighbours)
# Computation
# (deletes points with less than 3 neighbours)
# Computation
# (deletes points with less than 3 neighbours)
python = GhPythonScript(x=pt)  # -> out, a; inputs x: list of Point3d; disabled
# ---------- python: Python ----------
__author__ = "pimvo"
__version__ = "2018.12.18"

import rhinoscriptsyntax as rs
import Rhino.Geometry as rg
import math as math

pointlist = x
shortlist = []
for i in range(len(pointlist)):
    ngh = 0
    for j in range(len(pointlist)):
        dist = pointlist[i].DistanceTo(pointlist[j])
        if dist < 5.1 and dist > 0:
            ngh = ngh +1
    if ngh > 2:
        shortlist.append(pointlist[i])

a = []
a = shortlist
# ---------- end python ----------
# PROCESS
python_2 = GhPythonScript(x=python.a)  # -> out, a; inputs x: list of Point3d; same code as python
python_3 = GhPythonScript(x=python_2.a)  # -> out, a; inputs x: list of Point3d; same code as python
python_4 = GhPythonScript(x=python_3.a)  # -> out, a; inputs x: list of Point3d; same code as python

pt_2 = Point(python_4.a)
number_slider = Slider(4, range=0..10)
# OUTPUT
xy = XYPlane(Origin=pt_2)
# Places Voxels on Remaining Points
# (this is the grid to grow in)
prot = RotatePlane(Plane=xy, Angle=Slider(0.914, range=0..1))
multiplication = Multiplication(A=Slider(0.5, range=0..1), B=number_slider)
multiplication_2 = Multiplication(A=Slider(0.5, range=0..1), B=number_slider)
multiplication_3 = Multiplication(A=Slider(0.4, range=0..1), B=number_slider)
box = CenterBox(Base=prot, X=multiplication, Y=multiplication_2, Z=multiplication_3)
