# Grasshopper definition VoxelsAndSolar.gh (Grasshopper 1.0.7)

line = Line(Line((92377.51482, 438271.4711, 0), (92378.77878, 438270.4622, 0)))
line_2 = Line(Line((92377.51482, 438271.4711, 0), (92379.08066, 438273.3109, 0)))
# Voxelator and Solar Envelope Maker
# GH File Supplied by Dr. Ir. P. Nourian
# Set New Base Plane
point = Point(Point(92376.90461, 438271.2001, 0))
construct_plane = ConstructPlane(Origin=point, XAxis=line, YAxis=line_2)

panel = Panel("Input Geometry here")

mesh = Mesh([<mesh referenced from the Rhino model> x170])
bounding_box = BoundingBox(Content=mesh, Plane=construct_plane, UnionBox=True)  # -> Box, Box_2
# Create Large Bounding Box from exisiting geometry
box_corners = BoxCorners(Box=bounding_box.Box)  # -> CornerA, CornerB, CornerC, CornerD, CornerE, CornerF, CornerG, CornerH
srf4pt = _4PointSurface(CornerA=box_corners.CornerA, CornerB=box_corners.CornerB, CornerC=box_corners.CornerC, CornerD=box_corners.CornerD)
boxrec = BoxRectangle(Rectangle=srf4pt, Height=Slider(100, range=0..100))

# ----
# Sun Simulator (after Ted Nagi's VB Code)
lat = Number(51.9244)
lon = Number(4.4777)
list = ValueList({"Winter": 0, "Summer": 1, "Year": 2, "Month": 3}, selected="Year")
winter = Panel("""10
11
12
1
2
3""")
summer = Panel("""4
5
6
7
8
9""")
year = Panel("""1
2
3
4
5
6
7
8
9
10
11
12""")
list_2 = ValueList({"Jan": 1, "Feb": 2, "Mar": 3, "Apr": 4, "May": 5, "Jun": 6, "Jul": 7, "Aug": 8, "Sep": 9, "Oct": 10, "Nov": 11, "Dec": 12}, selected="Jan")
filter = StreamFilter(Gate=list, Stream0=winter, Stream1=summer, Stream2=year, Stream3=list_2)
solarwinhours = CSharpScript(W=Slider(3, range=0..10), h=Slider(0.5, range=0..1))  # -> out, A; inputs W: Double, h: Double
# ---------- solarwinhours: C# ----------
    double minHour = 12 - W;
    double maxHour = 12 + W;
    int n= (int) Math.Round((12 - 2 * W) / h);//HowManyMoments
    double[] hours = new double[n+1];
    for(int i = 0;i <= n;i++){
      double hour = minHour + i * (2 * W) / n;
      hours[i] = hour;
    }
    A = hours;
# ---------- end solarwinhours ----------
time_zone = Number(3.5)
day = Number(21)
yr = Number(2016)
solartimeangles = CSharpScript(yr=yr, mth=graft(filter), day=day, hrs=solarwinhours.A, tzone=time_zone, latitude=lat, longitude=lat, scaleRad=50)  # -> out, zenAng, azi, hrAngle, solarElev, eqaTime, solDec, sunPt, sunVec; inputs yr: Int32, mth: Int32, day: Int32, hrs: Double, tzone: Double, latitude: Double, longitude: Double, northAng: Double, scaleRad: Double
# ---------- solartimeangles: C# usings ----------
using System.IO;
using System.Linq;
using System.Data;
using System.Drawing;
using System.Reflection;
using System.Windows.Forms;
using System.Xml;
using System.Xml.Linq;
using System.Runtime.InteropServices;

using Rhino.DocObjects;
using Rhino.Collections;
using GH_IO;
using GH_IO.Serialization;
# ---------- solartimeangles: C# ----------
    // The Solar Position algorithm is based on National Oceanic and Atmospheric Administration's Solar Position Calculator http://www.srrb.noaa.gov/highlights/sunrise/azel.html
    //Code is ported into vb.net and integrated into Grasshopper by Ted Ngai Jan 30, 2009 www.tedngai.net
    //Translation to C# by Pirouz Nourian
    double hourAngle = 0;
    double haRad = 0;
    double csz = 0;
    double zenith = 0;
    double azDenom = 0;
    double azRad = 0;
    double azimuth = 0;
    double exoatmElevation = 0;
    double refractionCorrection = 0;
    double te = 0;
    double solarZen = 0;
    double elevation = 0;
    double coszen = 0;

    //timenow is GMT time for calculation
    double timenow = hrs - tzone;
    longitude = longitude * -1;

    double JD = calcJD(yr, mth, day);
    double T = calcTimeJulianCent(JD + timenow / 24.0);
    double R = calcSunRadVector(T);
    double alpha = calcSunRtAscension(T);
    double theta = calcSunDeclination(T);
    double Etime = calcEquationOfTime(T);
    //Dim theta As Double = calcGeomMeanLongSun(T)

    double eqTime = Etime;
    double solarDec = theta;
    double earthRadVec = R;

    double solarTimeFix = eqTime - 4.0 * longitude + 60.0 * -tzone;
    double trueSolarTime = hrs * 60 + solarTimeFix;

    if (trueSolarTime > 1440) {
      trueSolarTime -= 1440;
    }

    hourAngle = trueSolarTime / 4.0 - 180.0;
    if (hourAngle < -180) {
      hourAngle = hourAngle + 360;
    }

    haRad = degToRad(hourAngle);

    csz = Math.Sin(degToRad(latitude)) * Math.Sin(degToRad(solarDec)) + Math.Cos(degToRad(latitude)) * Math.Cos(degToRad(solarDec)) * Math.Cos(haRad);
    if (csz > 1.0) {
      csz = 1.0;
    } else if (csz < -1.0) {
      csz = -1;
    }

    zenith = radToDeg(Math.Acos(csz));
    azDenom = (Math.Cos(degToRad(latitude)) * Math.Sin(degToRad(zenith)));


    if (Math.Abs(azDenom) > 0.001) {
      azRad = ((Math.Sin(degToRad(latitude)) * Math.Cos(degToRad(zenith))) - Math.Sin(degToRad(solarDec))) / azDenom;
      if (Math.Abs(azRad) > 1.0) {
        if (azRad < 0) {
          azRad = -1.0;
        } else {
          azRad = 1.0;
        }
      }

      azimuth = 180.0 - radToDeg(Math.Acos(azRad));
      if (hourAngle > 0.0) {
        azimuth = -azimuth;
      }
    } else {
      if (latitude > 0.0) {
        azimuth = 180.0;
      } else {
        azimuth = 0.0;
      }
    }

    if (azimuth < 0.0) {
      azimuth = azimuth + 360;
    }

    exoatmElevation = 90.0 - zenith;
    if (exoatmElevation > 85.0) {
      refractionCorrection = 0.0;
    } else {
      te = Math.Tan(degToRad(exoatmElevation));
      if (exoatmElevation > 5.0) {
        refractionCorrection = 58.1 / te - 0.07 / (te * te * te) + 8.6E-05 / (te * te * te * te * te);
      } else if (exoatmElevation > -0.575) {
        refractionCorrection = 1735.0 + exoatmElevation * (-518.2 + exoatmElevation * (103.4 + exoatmElevation * (-12.79 + exoatmElevation * 0.711)));
      } else {
        refractionCorrection = -20.774 / te;
      }
      refractionCorrection = refractionCorrection / 3600.0;
    }

    solarZen = zenith - refractionCorrection;
    elevation = (Math.Floor(100 * (90.0 - solarZen))) / 100;
    if (solarZen < 108.0) {
      azimuth = (Math.Floor(100 * azimuth)) / 100;

      if (solarZen < 90.0) {
        coszen = (Math.Floor(10000.0 * (Math.Cos(degToRad(solarZen))))) / 10000.0;
      } else {
        coszen = 0.0;
      }
    }
    double ThetaAngle = degToRad(azimuth + northAng);

    zenAng = coszen;
    azi = ThetaAngle;
    hrAngle = hourAngle;
    double PhiAngle = degToRad(elevation);
    solarElev = PhiAngle;
    eqaTime = eqTime;
    solDec = solarDec;

    double x,y,z;
    Plane BasePlane = Plane.WorldXY;
    BasePlane.Rotate(Math.PI / 2, Vector3d.ZAxis);
    x = scaleRad * Math.Cos(PhiAngle) * Math.Cos(-ThetaAngle);
    y = scaleRad * Math.Cos(PhiAngle) * Math.Sin(-ThetaAngle);
    z = scaleRad * Math.Sin(PhiAngle);

    Point3d sunPoint = BasePlane.PointAt(x, y, z);
    sunPt = sunPoint;
    Vector3d sunVector = -(new Vector3d(sunPoint));
    sunVector.Unitize();
    sunVec = sunVector;
# ---------- solartimeangles: C# additional code ----------
  //Basic Functions
  //-----------------------------------------
  //Convert radian angle to degrees
  public double radToDeg(double angleRad)
  {
    return (180.0 * angleRad / Math.PI);
  }
  public double degToRad(double angleDeg)
  {
    return Math.PI * angleDeg / 180.0;
  }
  //Purpose: Julian day from calendar day
  //Arguments:
  //year : 4 digit year
  //month : January = 1
  //day : 1-31
  //Return value: The Julian day corresponding to the date
  //Note: Number is returned for start of day. Fractional days should be added later.
  public double calcJD(int yr, int mth, int day)
  {
    if (mth <= 2) {
      yr = yr - 1;
      mth = mth + 12;
    }
    double A = Math.Floor(yr / 100.0);
    double B = 2 - A + Math.Floor(A / 4.0);
    double JD = Math.Floor(365.25 * (yr + 4716)) + Math.Floor(30.6001 * (mth + 1)) + day + B - 1524.5;
    return JD;
  }
  //Purpose: convert Julian Day to centuries since J2000.0
  //Arguments: jd - the Julian Day to convert
  //Return value: the T value corresponding to the Julian Day
  public double calcTimeJulianCent(double jd)
  {
    double T = (jd - 2451545.0) / 36525.0;
    return T;
  }

  //Functions to calculate Rad Vector
  //--------------------------------
  //Purpose: calculate the Geometric Mean Longitude of the Sun
  //Arguments: t - number of Julian centuries since J2000.0
  //Return value: the Geometric Mean Longitude of the Sun in degrees
  public double calcGeomMeanLongSun(double t)
  {
    double LO = 280.46646 + t * (36000.76983 + 0.0003032 * t);
    while (LO > 360.0) {
      LO -= 360.0;
    }
    while (LO < 0.0) {
      LO += 360;
    }
    return LO;
  }
  //Purpose: calculate the Geometric Mean Anomaly of the Sun
  //Arguments: t - number of Julian centuries since J2000.0
  //Return value: the Geometric Mean Anomaly of the Sun in degrees
  public double calcGeomMeanAnomalySun(double t)
  {
    double M = 357.52911 + t * (35999.05029 - 0.0001537 * t);
    return M;
  }
  //Purpose: calculate the eccentricity of earth's orbit
  //Arguments: t - number of Julian centuries since J2000.0
  //Return value: the unitless eccentricity
  public double calcEccentricityEarthOrbit(double t)
  {
    double e = 0.016708634 - t * (4.2037E-05 + 1.267E-07 * t);
    return e;
  }
  //Purpose: calculate the equation of center for the sun
  //Arguments: t : number of Julian centuries since J2000.0
  //Return value: in degrees
  public double calcSunEqOfCenter(double t)
  {
    double m = calcGeomMeanAnomalySun(t);
    double mrad = degToRad(m);
    double sinm = Math.Sin(mrad);
    double sin2m = Math.Sin(mrad + mrad);
    double sin3m = Math.Sin(mrad + mrad + mrad);

    double C = sinm * (1.914602 - t * (0.004817 + 1.4E-05 + t)) + sin2m * (0.019993 - 0.000101 * t) + sin3m * 0.000289;
    return C;
  }
  //Purpose: calculate the true longitude of the sun
  //Arguments: t : number of Julian centuries since J2000.0
  //Return value: sun's true longitude in degrees
  public double calcSunTrueLong(double t)
  {
    double lo = calcGeomMeanLongSun(t);
    double c = calcSunEqOfCenter(t);
    double O = lo + c;
    return O;
  }
  //Purpose: calculate the true anamoly of the sun
  //Arguments: t : number of Julian centuries since J2000.0
  //Return value: sun's true anamoly in degrees
  public double calcSunTrueAnomaly(double t)
  {
    double m = calcGeomMeanAnomalySun(t);
    double c = calcSunEqOfCenter(t);
    double v = m + c;
    return v;
  }
  //Purpose: calculate the disTance to the sun in AU
  //Arguments: t : number of Julian centuries since J2000.0
  //Return value: sun radius vector in AUs
  public double calcSunRadVector(double t)
  {
    double v = calcSunTrueAnomaly(t);
    double e = calcEccentricityEarthOrbit(t);
    double R = (1.000001018 * (1 - e * e)) / (1 + e * Math.Cos(degToRad(v)));
    return R;
  }

  //Functions to calculate Ascension
  //-----------------------------------------------
  //Purpose: calculate the apparent longitude of the sun
  //Arguments: t : number of Julian centuries since J2000.0
  //Return value: sun's apparent longitude in degrees
  public double calcSunApparentLong(double t)
  {
    double o = calcSunTrueLong(t);
    double omega = 125.04 - 1934.136 * t;
    double lambda = o - 0.00569 - 0.00478 * Math.Sin(degToRad(omega));
    return lambda;
  }
  //Purpose: calculate the mean obliquity of the ecliptic
  //Arguments: t : number of Julian centuries since J2000.
  //Return value: mean obliquity in degrees
  public double calcMeanObliquityOfEcliptic(double t)
  {
    double seconds = 21.448 - t * (46.815 + t * (0.00059 - t * (0.001813)));
    double eO = 23.0 + (26.0 + (seconds / 60.0)) / 60.0;
    return eO;
  }
  //Purpose: calculate the corrected obliquity of the ecliptic
  //Arguments: t : number of Julian centuries since J2000.0
  //Return value: corrected obliquity in degrees
  public double calcObliquityCorrection(double t)
  {
    double eO = calcMeanObliquityOfEcliptic(t);
    double omega = 125.04 - 1934.136 * t;
    double e = eO + 0.00256 * Math.Cos(degToRad(omega));
    return e;
  }
  //Purpose: calculate the right ascension of the sun
  //Arguments: t : number of Julian centuries since J2000.0
  //Return value: sun's right ascension in degrees
  public double calcSunRtAscension(double t)
  {
    double e = calcObliquityCorrection(t);
    double lambda = calcSunApparentLong(t);
    double Tananum = (Math.Cos(degToRad(e)) * Math.Sin(degToRad(lambda)));
    double Tanadenom = (Math.Cos(degToRad(lambda)));
    double alpha = radToDeg(Math.Atan2(Tananum, Tanadenom));
    return alpha;
  }


  //-----------------------------------------
  //Purpose: calculate the declination of the sun
  //Arguments: t : number of Julian centuries since J2000.0
  //Return value: sun's declination in degrees
  public double calcSunDeclination(double t)
  {
    double e = calcObliquityCorrection(t);
    double lambda = calcSunApparentLong(t);
    double sint = Math.Sin(degToRad(e)) * Math.Sin(degToRad(lambda));
    double theta = radToDeg(Math.Asin(sint));
    return theta;
  }


  //------------------------------------
  //Calculate the difference between true solar time and mean solar time
  //Arguments: t : number of Julian centuries since J2000.0
  //Return value: equation of time in minutes of time
  public double calcEquationOfTime(double t)
  {
    double epsilon = calcObliquityCorrection(t);
    double lo = calcGeomMeanLongSun(t);
    double e = calcEccentricityEarthOrbit(t);
    double m = calcGeomMeanAnomalySun(t);
    double y = Math.Tan(degToRad(epsilon) / 2.0);
    y = y * y;
    double sin210 = Math.Sin(2.0 * degToRad(lo));
    double sinm = Math.Sin(degToRad(m));
    double cos210 = Math.Cos(2.0 * degToRad(lo));
    double sin410 = Math.Sin(4.0 * degToRad(lo));
    double sin2m = Math.Sin(2.0 * degToRad(m));

    double Etime = y * sin210 - 2.0 * e * sinm + 4.0 * e * y * sinm * cos210 - 0.5 * y * y * sin410 - 1.25 * e * e * sin2m;
    return radToDeg(Etime) * 4.0;
  }


  //----------------------------------------
  //Return the hour angle for the given location, decl, and time of day
  public double calcHourAngle(double time, double longitude, double eqtime)
  {
    return 15.0 * (time - (longitude / 15.0) - (eqtime / 60.0));
  }
# ---------- end solartimeangles ----------
vec = Vector(flatten(solartimeangles.sunVec))
vdis = VectorDisplay(Anchor=solartimeangles.sunPt, Vector=solartimeangles.sunVec)

panel_2 = Panel("Sun Vectors")

# ----
# INPUT
mesh_2 = Mesh([<mesh referenced from the Rhino model> x369])
plane = Plane(construct_plane)
# Set Points of Interest from chosen meshes and find normals
face_normals = FaceNormals(Mesh=mesh_2)  # -> Centers, Normals
deconstruct_plane = DeconstructPlane(Plane=plane)  # -> Origin, XAxis, YAxis, ZAxis
ghpython_script = GhPythonScript(centers=face_normals.Centers, normals=face_normals.Normals, u=deconstruct_plane.XAxis, v=deconstruct_plane.YAxis)  # -> out, flatten(a), flatten(b), c; inputs centers: list of Point3d, normals: list of Vector3d
# ---------- ghpython_script: Python ----------
__author__ = "pimvo"
__version__ = "2018.12.04"

import Rhino.Geometry as rg
import math as math
import scriptcontext as sc
poi = []
poivectors = []

def dotproduct(v1, v2):
  return sum((a*b) for a, b in zip(v1, v2))

def length(v):
    return math.sqrt(dotproduct(v, v))

def angle(v1, v2):
    if (length(v1) * length(v2)) == 0:
        temp = 2
    else:
        temp = math.acos(dotproduct(v1, v2) / (length(v1) * length(v2)))
    return temp



for i in range(0,len(normals)):
     xangle = angle(normals[i],u)
     yangle = angle(normals[i],v)
     if xangle < 1.5707963 or yangle < 1.5707963:
        poi.append(centers[i])
        poivectors.append(normals[i])

a = poi
b = poivectors
# ---------- end ghpython_script ----------
poi = Point(ghpython_script.a)

number_slider = Slider(4, range=0..20)
brep = Brep(boxrec)
rad = Radians(Degrees=Slider(51, range=0..180))
xy = XYPlane(Origin=Point(346.2829891, 168.4162942, 0))
Z = UnitZ(Factor=Slider(40, range=0..100))
# Voxelate the Bounding Box
mesh_3 = MeshBrep(
    Brep=brep,
    Settings={GridMaxCount=0, GridMinCount=16, JaggedSeams=False, MaxEdgeLength=0, MinEdgeLength=0.0001, MinTolerance=0, Refine=True, RefineAngle=0, RelativeTolerance=0.65, SimplePlanes=True, Tolerance=0})
multiplication = Multiplication(A=Slider(1, range=0..10), B=number_slider)
multiplication_2 = Multiplication(A=Slider(1, range=0..10), B=number_slider)
multiplication_3 = Multiplication(A=Slider(0.8, range=0..10), B=number_slider)
prot = RotatePlane(Plane=xy, Angle=rad)
voxelator = CSharpScript(BVol=mesh_3, BPlane=prot, x=multiplication_2, y=multiplication, z=multiplication_3)  # -> out, A, Voxize, Voxenters, Boxels; inputs BVol: Mesh, BPlane: Plane, x: Double, y: Double, z: Double
# ---------- voxelator: C# ----------
    /*the algorithm has been designed based on 
    [1]	P. Nourian, R. Gonçalves, S. Zlatanova, K. A. Ohori, and A. Vu Vo, “Voxelization algorithms for geospatial applications: Computational methods for voxelating spatial datasets of 3D city models containing 3D surface, curve and point data models,” MethodsX, vol. 3, pp. 69–86, 2016.
    The code has been written by Pirouz Nourian and is licensed with 'a modified BSD 3-Clause License'
    Copyright (c) 2018, Pirouz Nourian
    All rights reserved.
    A full description of the license is privided in the git repository: https://gitlab.com/Pirouz-Nourian/spatial_computing/tree/master  
*/  

    Vector3d VoxelSize = new Vector3d(x, y, z);
    Voxize = VoxelSize;

    if(!BVol.IsClosed){throw new Exception("the bounding volume is not a closed/solid mesh; therefore this method cannot work!");}

    double epsilon = 10E-3;
    if((x < epsilon) || (y < epsilon) || (z < epsilon)){throw new Exception("either of the sizes is too tiny to work with!");}
    double tolerance = 0.1 * Math.Min(x, y);
    List<Tuple<int,int,int>> voxels = new List<Tuple<int,int,int>>();//could have been called the raster2D as a sparse matrix

    BoundingBox BBox = BVol.GetBoundingBox(BPlane);
    //B = BBox;

    int iCount = (int) Math.Round(BBox.Diagonal.X / x);
    int jCount = (int) Math.Round(BBox.Diagonal.Y / y);
    int kCount = (int) Math.Round(BBox.Diagonal.Z / z);



    double halfX = 0.5 * x;
    double halfY = 0.5 * y;
    double halfZ = 0.5 * z;
    Vector3d e_x = BPlane.XAxis;
    Vector3d e_y = BPlane.YAxis;
    Vector3d e_z = BPlane.ZAxis;

    Point3d Min = BBox.Min;
    Point3d Origin = BPlane.Origin;

    Origin = Origin + Min.X * e_x + Min.Y * e_y + Min.Z * e_z;//BPlane.PointAt(MinCorner.X, MinCorner.Y, MinCorner.Z);

    Origin.X = x * Math.Round(Origin.X / x);
    Origin.Y = y * Math.Round(Origin.Y / y);
    Origin.Z = z * Math.Round(Origin.Z / z);;
    //A = Origin;
    List<Mesh> BoxelMeshes = new List<Mesh>();
    List<Point3d> voxelPoints = new List<Point3d>();

    for(int i = 0;i < iCount;i++){
      for(int j = 0;j < jCount;j++){
        for(int k = 0;k < kCount;k++){
          Point3d voxelPoint = Origin + i * x * e_x + j * y * e_y + k * z * e_z;
          if(BVol.IsPointInside(voxelPoint, tolerance, false))
          {
            Tuple<int,int,int> voxel = Tuple.Create(i, j, k);
            voxels.Add(voxel);
            //voxelPoints.Add(voxelPoint);
            Mesh BoxelMesh = new Mesh();
            Point3d v000 = voxelPoint - halfX * e_x - halfY * e_y - halfZ * e_z;
            voxelPoints.Add(voxelPoint);
            Point3d v001 = v000 + x * e_x;
            Point3d v010 = v000 + y * e_y;
            Point3d v011 = v000 + x * e_x + y * e_y;
            Point3d v100 = v000 + z * e_z;
            Point3d v101 = v000 + x * e_x + z * e_z;
            Point3d v110 = v000 + y * e_y + z * e_z;
            Point3d v111 = v000 + x * e_x + y * e_y + z * e_z;
            Point3d[] vertices = new Point3d[]{v000,v001,v010,v011,v100,v101,v110,v111};
            BoxelMesh.Vertices.AddVertices(vertices);
            MeshFace fLeft = new MeshFace(0, 4, 6, 2);
            MeshFace fRight = new MeshFace(1, 3, 7, 5);
            MeshFace fBack = new MeshFace(0, 1, 5, 4);
            MeshFace fFront = new MeshFace(2, 6, 7, 3);
            MeshFace fBottom = new MeshFace(0, 2, 3, 1);
            MeshFace fTop = new MeshFace(4, 5, 7, 6);
            MeshFace[] faces = new MeshFace[]{fLeft,fRight,fBack,fFront,fBottom,fTop};
            BoxelMesh.Faces.AddFaces(faces);
            BoxelMeshes.Add(BoxelMesh);
          }
        }
      }
    }
    Boxels = BoxelMeshes;
    Voxenters = voxelPoints;

    //    string Description = "pixels as (i,j) tuples, array size as tuple of (int,int), pixel size x,pixelsize y, Plane, origin point";
    //    Tuple<string,List<Tuple<int,int>>,Tuple<int,int>,double, double, Point3d,Plane> Raster2D;
    //    Raster2D = Tuple.Create(Description, pixels, Tuple.Create(iCount, jCount), x, y, Origin, BPlane);
    //    Raster2DTuple = Raster2D;
    //    PixelTuples = pixels;
# ---------- end voxelator ----------
voxize = Vector(voxelator.Voxize)
boxels = Mesh(voxelator.Boxels)

multiplication_4 = Multiplication(A=Slider(0.002, range=0..0.1), B=Slider(0.09, range=0..0.1))
# PROCESS
# Intersect voxels and sun rays to find solar envelope
sunvecs = Vector(vec)
points = Point(poi)
percent = Number(multiplication_4)
mesh_4 = Mesh(boxels)
normals = Vector(ghpython_script.b)
solarenvelope = CSharpScript(SunVecs=sunvecs, Boxels=mesh_4, Points=points, Normals=normals, Percent=percent)  # -> out, Blockage, NonBlocking, FBoxels, A; inputs SunVecs: list of Vector3d, Boxels: list of Mesh, Points: list of Point3d, Normals: list of Vector3d, Percent: Double
# ---------- solarenvelope: C# ----------
            /*
  The algorithm is designed based on the following papers:

  [1] F. De Luca, “Solar Form-finding . Subtractive Solar Envelope and Integrated Solar Collection Computational Method for High-rise Bui ....,”
  Proc. 37th Annu. Conf. Assoc. Comput. Aided Des. Archit. (ACADIA 2017), no. November, pp. 212–221, 2017.

  [2] P. Nourian, R. Gonçalves, S. Zlatanova, K. A. Ohori, and A. Vu Vo,
  “Voxelization algorithms for geospatial applications: Computational methods for voxelating spatial datasets of 3D city models containing 3D surface, curve and point data models,”
  MethodsX, vol. 3, pp. 69–86, 2016.

  The code has been written by Pirouz Nourian and is licensed with 'a modified BSD 3-Clause License'
  A full description of the license is privided in the git repository: https://gitlab.com/Pirouz-Nourian/spatial_computing/tree/master
  Copyright (c) 2018, Pirouz Nourian
  All rights reserved.
*/
    int n = SunVecs.Count;
    int PointCount = Points.Count;
    int NormalCount = Normals.Count;
    int VoxelCount = Boxels.Count;
    if((Percent < 0) || (Percent > 1)){throw new Exception("the percentage tolerance provided must be a number between 0 and 1!");}
    if((PointCount < 1) || (n < 1) || (VoxelCount < 1)){throw new Exception("The number of items in some inputs is not sufficient!");}
    if(PointCount != NormalCount){throw new Exception("The number of normal vectors and points must be the same!");}

    double[] BlockedFluxes = new double[VoxelCount];
    bool[] IsNotBlocking = new bool[VoxelCount];

    int Sum = PointCount * n;//in order to relativize the blockage numbers, we divide them all by the total number of rays which could have been blocked
    List<Mesh> FilteredBoxels = new List<Mesh>();
    for(int i = 0; i < VoxelCount; i++){//foreach(Mesh Boxel in Boxels){
      Mesh Boxel = Boxels[i];
      double BlockedFlux = 0;
      foreach(Vector3d SunVec in SunVecs){
        Vector3d NSunVec = -SunVec;
        for(int k = 0;k < PointCount;k++){//foreach(Point3d Point in Points){
          Point3d Point = Points[k];
          Vector3d Normal = Normals[k];
          double PotentialFlux = Vector3d.Multiply(NSunVec, Normal);
          if(PotentialFlux > 1){throw new Exception("some sunvectors or normal vectors have a norm greater than 1!");}
          if(PotentialFlux > 0){
            Ray3d Ray = new Ray3d(Point, NSunVec);
            double RayParameter = Rhino.Geometry.Intersect.Intersection.MeshRay(Boxel, Ray);
            bool Hit = (RayParameter > 0);
            if(Hit){
              BlockedFlux = BlockedFlux + PotentialFlux;
            }
          }
        }
      }
      BlockedFlux = BlockedFlux / Sum;
      BlockedFluxes[i] = BlockedFlux;
      if(BlockedFlux < Percent){
        FilteredBoxels.Add(Boxel);
        IsNotBlocking[i] = true;
      }else{
        IsNotBlocking[i] = false;
      }
    }
    Blockage = BlockedFluxes;
    NonBlocking = IsNotBlocking;
    FBoxels = FilteredBoxels;
# ---------- end solarenvelope ----------

# ----
# OUTPUT
panel_3 = Panel("Solar Envelope Mesh")
mesh_5 = Mesh(solarenvelope.FBoxels)

num = Number(solarenvelope.Blockage)
bnd = Bounds(Numbers=num)
# (Optional) Color Solar Envelope Mesh for analysis
dedomain = DeconstructDomain(Domain=bnd)  # -> Start, End
demesh = DeconstructMesh(Mesh=mesh_5)  # -> Vertices, Faces, Colours, Normals
gradient = Gradient(
    LowerLimit=dedomain.Start,
    UpperLimit=dedomain.End,
    Parameter=num,
    stops=[0: RGB(234, 38, 0), 0.25: RGB(234, 126, 0), 0.5: RGB(254, 244, 84), 0.75: RGB(173, 203, 249), 1: RGB(75, 107, 169)])
lng = ListLength(List=demesh.Vertices)  # -> flatten(Length)
col = Colour(gradient)
cull = CullPattern(List=col, CullPattern=[False, False, True, True])
col_2 = Colour(cull)
col_3 = Colour(col_2)
repeat = RepeatData(Data=graft(col_3), Length=graft(lng))  # -> simplify(Data)
mcol = MeshColours(Mesh=graft(mesh_5), Colours=repeat)  # -> flatten(Mesh)
mesh_6 = Mesh(mcol)
