# Grasshopper definition BlockPlacer.gh (Grasshopper 1.0.7)

# ----
# Input Voxel here to get points for every voxel
brep = Brep()
bbox = BoundingBox(Content=brep, Plane=PlaneXY(0, 0, 0))  # -> Box, Box_2
volume = Volume(Geometry=bbox.Box)  # -> Volume, Centroid
pt = Point(volume.Centroid)

# ----
# Translate Geometry along a vector from the origin point to a new point
# INPUT
panel = Panel("Input Geometry")

panel_2 = Panel("Origin Point")
pt_2 = ConstructPoint(XCoordinate=0, YCoordinate=0, ZCoordinate=0)

panel_3 = Panel("Target Point(s)")
pt_3 = Point([Point(3.50740227, 14.43527834, 0), Point(15.98199119, 15.62588367, 0), Point(22.25401833, 25.76728477, 0), Point(31.809797, 12.40878517, 0)])

geo = Geometry(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)
geo_2 = Geometry(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)
geo_3 = Geometry(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)
geo_4 = Geometry(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)
geo_5 = Geometry(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)

# ----
# PROCESS
vec2pt = Vector2Pt(PointA=pt_2, PointB=pt_3, Unitize=False)  # -> Vector, Length
vec2pt_2 = Vector2Pt(PointA=pt_2, PointB=pt_3, Unitize=False)  # -> Vector, Length
vec2pt_3 = Vector2Pt(PointA=pt_2, PointB=pt_3, Unitize=False)  # -> Vector, Length
vec2pt_4 = Vector2Pt(PointA=pt_2, PointB=pt_3, Unitize=False)  # -> Vector, Length
vec2pt_5 = Vector2Pt(PointA=pt_2, PointB=pt_3, Unitize=False)  # -> Vector, Length
move = Move(Geometry=geo_2, Motion=vec2pt.Vector)  # -> Geometry, Transform
move_2 = Move(Geometry=geo, Motion=vec2pt_2.Vector)  # -> Geometry, Transform
move_3 = Move(Geometry=geo_5, Motion=vec2pt_4.Vector)  # -> Geometry, Transform
move_4 = Move(Geometry=geo_3, Motion=vec2pt_3.Vector)  # -> Geometry, Transform
move_5 = Move(Geometry=geo_4, Motion=vec2pt_5.Vector)  # -> Geometry, Transform

# ----
# OUTPUT
panel_4 = Panel("Output Geometry")
brep_2 = Brep(move.Geometry)
brep_3 = Brep([move_3.Geometry, move_5.Geometry, move_4.Geometry, move_2.Geometry])
