# Grasshopper definition GrasshopperMaxFéRuben.gh (Grasshopper 1.0.7)
# plug-ins: GH_CPython

# ---- group: Start & End point
end_index = DigitScroller(Scroller_Digits=12, Scroller_Prefix="End index", Scroller_Radix=11, Scroller_Value=143)  # disabled
starting_index = DigitScroller(Scroller_Digits=12, Scroller_Prefix="Starting index", Scroller_Radix=11, Scroller_Value=34)  # disabled

# ---- group: Center points
supermarketcenter = Point(<point referenced from the Rhino model>)  # disabled
workspacecenter = Point(<point referenced from the Rhino model>)  # disabled
restaurantcenter = Point(<point referenced from the Rhino model>)  # disabled
assistedcenter = Point(<point referenced from the Rhino model>)  # disabled
studentcenter = Point(<point referenced from the Rhino model>)  # disabled
cinamacenter = Point(<point referenced from the Rhino model>)  # disabled
startercenter = Point(<point referenced from the Rhino model>)  # disabled
atriumcenter = Point(<point referenced from the Rhino model>)  # disabled
gymcenter = Point(<point referenced from the Rhino model>)  # disabled

# ----
# Percentage: Move the slider to see the growing process from start to end.
percentage = Slider(1, range=0..1)  # disabled

# ---- group: Park paths
# Paths: Each of the paths reference to a curve in Rhino; the width of those paths can be changed with these sliders.
path_width = Slider(5000, range=0..5000)  # disabled
path_width_2 = Slider(5000, range=0..5000)  # disabled
path_width_3 = Slider(2000, range=0..5000)  # disabled
path_width_4 = Slider(5000, range=0..5000)  # disabled
path_width_5 = Slider(2000, range=0..5000)  # disabled
path = Curve(<curve referenced from the Rhino model>)  # disabled
path_2 = Curve(<curve referenced from the Rhino model>)  # disabled
path_3 = Curve(<curve referenced from the Rhino model>)  # disabled
path_4 = Curve(<curve referenced from the Rhino model>)  # disabled
path_5 = Curve(<curve referenced from the Rhino model>)  # disabled

offset = OffsetCurve(Curve=path, Distance=expr("x*0.5", path_width), Plane=PlaneXY(0, 0, 0), Corners=1)  # disabled
offset_2 = OffsetCurve(Curve=path, Distance=expr("x*-0.5", path_width), Plane=PlaneXY(0, 0, 0), Corners=1)  # disabled
offset_3 = OffsetCurve(Curve=path_3, Distance=expr("x*0.5", path_width_2), Plane=PlaneXY(0, 0, 0), Corners=1)  # disabled
offset_4 = OffsetCurve(Curve=path_3, Distance=expr("x*-0.5", path_width_2), Plane=PlaneXY(0, 0, 0), Corners=1)  # disabled
offset_5 = OffsetCurve(Curve=path_2, Distance=expr("x*0.5", path_width_3), Plane=PlaneXY(0, 0, 0), Corners=1)  # disabled
offset_6 = OffsetCurve(Curve=path_2, Distance=expr("x*-0.5", path_width_3), Plane=PlaneXY(0, 0, 0), Corners=1)  # disabled
offset_7 = OffsetCurve(Curve=path_4, Distance=expr("x*0.5", path_width_4), Plane=PlaneXY(0, 0, 0), Corners=1)  # disabled
offset_8 = OffsetCurve(Curve=path_4, Distance=expr("x*-0.5", path_width_4), Plane=PlaneXY(0, 0, 0), Corners=1)  # disabled
offset_9 = OffsetCurve(Curve=path_5, Distance=expr("x*0.5", path_width_5), Plane=PlaneXY(0, 0, 0), Corners=1)  # disabled
offset_10 = OffsetCurve(Curve=path_5, Distance=expr("x*-0.5", path_width_5), Plane=PlaneXY(0, 0, 0), Corners=1)  # disabled
loft = Loft(
    Curves=[offset, offset_2],
    Options={Adjust=False, Closed=False, LoftEnds=0, LoftSimp=0, LoftType=0, Rebuild=10, Refit=0.01})  # disabled
loft_2 = Loft(
    Curves=[offset_3, offset_4],
    Options={Adjust=False, Closed=False, LoftEnds=0, LoftSimp=0, LoftType=0, Rebuild=10, Refit=0.01})  # disabled
loft_3 = Loft(
    Curves=[offset_5, offset_6],
    Options={Adjust=False, Closed=False, LoftEnds=0, LoftSimp=0, LoftType=0, Rebuild=10, Refit=0.01})  # disabled
loft_4 = Loft(
    Curves=[offset_7, offset_8],
    Options={Adjust=False, Closed=False, LoftEnds=0, LoftSimp=0, LoftType=0, Rebuild=10, Refit=0.01})  # disabled
loft_5 = Loft(
    Curves=[offset_9, offset_10],
    Options={Adjust=False, Closed=False, LoftEnds=0, LoftSimp=0, LoftType=0, Rebuild=10, Refit=0.01})  # disabled

# ---- group: Park hills
# Hills: Splits the park into different zones using walking paths with a given width.
crv = Curve(<curve referenced from the Rhino model>)  # disabled
boundary = BoundarySurfaces(Edges=crv)  # disabled
merge = Merge(Data1=loft_5, Data2=loft_4, Data3=loft_2, Data4=loft_3, Data5=loft)  # disabled
rdiff = RegionDifference(CurvesA=boundary, CurvesB=merge)  # disabled
hills_step_height = Slider(600, range=100..1000)  # disabled
boundary_2 = BoundarySurfaces(Edges=rdiff)  # disabled
pt = Point([<point referenced from the Rhino model> x5])  # disabled
extr = ExtrudePoint(Base=boundary_2, Point=pt)  # -> graft(Extrusion); disabled
contour = Contour(Shape=extr, Point=Point(0, 0, 0), Direction=Vector(0, 0, 1), Distance=hills_step_height)  # disabled
divide = DivideCurve(Curve=contour, Count=20, Kinks=False)  # -> Points, Tangents, Parameters; disabled
nurbs = NurbsCurve(Vertices=divide.Points, Degree=2, Periodic=True)  # -> Curve, Length, Domain; disabled
Z = UnitZ(Factor=expr("x*-1", hills_step_height))  # disabled
extr_2 = Extrude(Base=nurbs.Curve, Direction=Z)  # disabled
cap = CapHoles(Brep=extr_2)  # disabled

# ----
footprint = Curve(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)  # disabled
x_size_large = Number(8000)  # disabled
y_size_large = Number(8000)  # disabled
z_size_large = Number(3240)  # disabled

building_height = Panel("50000")  # disabled
boundary_3 = BoundarySurfaces(Edges=footprint)  # disabled
Z_2 = UnitZ(Factor=building_height)  # disabled
extr_3 = Extrude(Base=boundary_3, Direction=Z_2)  # disabled
cap_2 = CapHoles(Brep=extr_3)  # disabled
brep = Brep(cap_2)  # disabled
xs = Number(x_size_large)  # disabled
ys = Number(y_size_large)  # disabled
zs = Number(z_size_large)  # disabled
voxelization = PythonScript(S=brep, xS=xs, yS=ys, zS=zs)  # -> temp, out, a, b, c, PntList; inputs S: Brep; disabled
# ---------- voxelization: Python ----------
import Rhino.Geometry as rg
import math as math
import scriptcontext as sc

#Find the bounding box of the brep in question
Bbox = S.GetBoundingBox(True)

#Find the Length, Width, and Height of the bounding boz of the Brep
W = Bbox.Diagonal.X
L = Bbox.Diagonal.Y
H = Bbox.Diagonal.Z

#Divide the 3 axis of the bounding box by the dimensions of the voxel
#This will give you a U, V, W value along the bounding box
#Turn this value into an integer by finding the next biggest integer (roundingUp)
UC = int(math.ceil(W/xS))
VC = int(math.ceil(L/yS))
WC = int(math.ceil(H/zS))

#Create a container for you Point List
#Create a container for your distance List
Point_list = []
Distance_list = []

#Create a base Plane for all the geometry 
Baseplane = rg.Plane(Bbox.Min, rg.Vector3d.XAxis, rg.Vector3d.YAxis)


#Due to the fact that all voxels are based on the center points, we need
#to create a shift towards the voxel's center, which is half of each dimension
xShift = xS*0.5
yShift = yS*0.5
zShift = zS*0.5

#Write a for-loop that itereates through all U, V, W values of the bounding box
#Create a point with consideration of the half shift at each U, V, W locaiton
#Store this point in the point list
#Create a 'closest point; from the brep to the point at the U,V,W value 
#find the distance of the point in the u, v ,w address to the closet point on the brep
#if the point is inside the brep, give it a negative value
#save distances to list
#out put both lists
for i in range(0,WC):
    for j in range (0,VC):
        for k in range (0,UC):
            point = Baseplane.PointAt(xShift +k * xS, yShift + j * yS, zShift + i * zS)
            if (S.IsPointInside(point,0.05,True)):
                Point_list.append(point)

PntList = Point_list
c = Distance_list
# ---------- end voxelization ----------
box_maker = GhPythonScript(centerPoint=voxelization.PntList, BoxSpanX=xs, BoxSpanY=ys, BoxSpanZ=zs)  # -> out, meshFaces, a, b, temp; inputs centerPoint: Point3d; disabled
# ---------- box_maker: Python ----------
__author__ = "Karim"
__version__ = "2018.05.23"

import rhinoscriptsyntax as rs
import Rhino.Geometry as rg

# define a function that draws a box based off a center point
# Input: Given a 3d point in space, and xyz dimensions
# Output: Desired a 3d box spanning xyz dimensions based of given center point
# e.g def boxMaker(point,spanX,spanY,spanZ):
def boxMaker (point, spanX, spanY, spanZ):
    
    # initialize a point at the origin, will be later redefined at desired locations
    newPnt = rg.Point3d(0,0,0)
    # deconstruct given point into x y z components as seperate variables
    x = point.X
    y = point.Y
    z = point.Z
    
    temp = []
    
    # initialize empty mesh
    M = rg.Mesh()
    # create a for loop that loops through the corner locations of box and 
    # draws a point at this location
    # utilize the span distance (note must divide by 2 since going from center)
    # e.g range(-0.5 * spanX, spanX*0.5)
    for xi in [-spanX*0.5,spanX*0.5]:
        for yi in [-spanY*0.5,spanY*0.5]:
            for zi in [-spanZ*0.5,spanZ*0.5]:
                newpt = rg.Point3d(x+xi,y+yi,z+zi)
                M.Vertices.Add(newpt)
                #redefine your new point at every corner
                #add all points as Vertices to the initialzed mesh
    M.Faces.AddFace(1,5,7,3)
    M.Faces.AddFace(5,4,6,7)
    M.Faces.AddFace(7,6,2,3)
    M.Faces.AddFace(3,2,0,1)
    M.Faces.AddFace(1,0,4,5)
    M.Faces.AddFace(4,0,2,6)
    
    
    return M

    # add points in counterclock wise motion for each face
    # eg. 0----1
    #     ------
    #     3----2
    # therefore you add the point in this order (0,3,2,1)
    # do this for all 6 faces of the cube
    # you might need to vizualize the point number in grasshopper to make it easier

    
    #return the final mesh with all the points and faces added
meshFaces = boxMaker(centerPoint,BoxSpanX,BoxSpanY,BoxSpanZ)
    
    
    # call your function with all required variables
    # output result of your function and save it into a variable
# ---------- end box_maker ----------

# ---- group: Solar model / centre of building
# NOTICE:
# Yellow elements are parameters that can be changed to alter the final look of the building. Other grey inputs are inputs that are fixed.
# 
# Some of the parameters:
# -Maxhits for the solar envelope
# -Centerpoints of the functions
# -Starting points of the pathfinding
# -Various parameters for the design
volume = Volume(Geometry=brep)  # -> Volume, Centroid; disabled
pdecon = Deconstruct(Point=volume.Centroid)  # -> XComponent, YComponent, ZComponent; disabled

# ---- group: Solar model / sun rays
sunrays = GhPythonScript(X=pdecon.XComponent, Y=pdecon.YComponent, Z=0)  # -> out, points, vectors; disabled
# ---------- sunrays: Python ----------
__author__ = "felis"
__version__ = "2018.11.30"

import rhinoscriptsyntax as rs
import Rhino.Geometry as rg
import math as math

pointslist = []
vectorlist = []
R=200000
hours = 6
months = 6
for theta in rs.frange(0, (2*math.pi / 24) * (hours), math.pi/12):
    for phi in rs.frange(-23.45*math.pi/180, 23.45*math.pi/180, (46.9*math.pi/180)/months):
        x = X + R * math.cos(phi) * math.cos(theta)
        y = Y + R * math.cos(phi) * math.sin(theta)
        z = Z + R * math.sin(phi)
        point = rg.Point3d(x, y, z)
        pointslist.append(point)
        vector = rg.Vector3d(X-x, Y-y, Z-z)
        vectorlist.append(vector)
        
points = pointslist
vectors = vectorlist
# ---------- end sunrays ----------
pt_2 = Point(sunrays.points)  # disabled

# ---- group: Solar model / latitude rotation
pt_3 = ConstructPoint(XCoordinate=pdecon.XComponent, YCoordinate=pdecon.YComponent, ZCoordinate=0)  # disabled
panel = Panel("-(90-51.92)*pi/180")  # disabled
panel_2 = Panel("-1")  # disabled
panel_3 = Panel("1")  # disabled
panel_4 = Panel("0")  # disabled
vec = VectorXYZ(XComponent=panel_2, YComponent=panel_3, ZComponent=panel_4)  # -> Vector, Length; disabled
rot3d = Rotate3D(Geometry=pt_2, Angle=panel, Center=pt_3, Axis=vec.Vector)  # -> Geometry, Transform; disabled

# ---- group: Solar model / rotation to the south
panel_5 = Panel("-(135+52.33)*pi/180")  # disabled
panel_6 = Panel("0")  # disabled
panel_7 = Panel("0")  # disabled
panel_8 = Panel("1")  # disabled
vec_2 = VectorXYZ(XComponent=panel_6, YComponent=panel_7, ZComponent=panel_8)  # -> Vector, Length; disabled
rot3d_2 = Rotate3D(Geometry=rot3d.Geometry, Angle=panel_5, Center=pt_3, Axis=vec_2.Vector)  # -> Geometry, Transform; disabled

# ---- group: Bridge
# Bridge: Creates a bridge that goes from one point on the building ("BuildingPoint") towards the traintracks.
mesh = Mesh(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)  # disabled
buildingpoint = Point(Point(34769.91945, 517208.7824, -46585.92041))  # disabled
volume_2 = Volume(Geometry=mesh)  # -> Volume, Centroid; disabled
num = Number(expr("x*2", z_size_large))  # disabled
pdecon_2 = Deconstruct(Point=buildingpoint)  # -> XComponent, YComponent, ZComponent; disabled
pdecon_3 = Deconstruct(Point=volume_2.Centroid)  # -> XComponent, YComponent, ZComponent; disabled
addition = Addition(A=pdecon_2.ZComponent, B=num)  # disabled
subtraction = Subtraction(A=pdecon_3.YComponent, B=15000)  # disabled
pt_4 = ConstructPoint(XCoordinate=pdecon_2.XComponent, YCoordinate=pdecon_2.YComponent, ZCoordinate=addition)  # disabled
addition_2 = Addition(A=subtraction, B=16000)  # disabled
pt_5 = ConstructPoint(XCoordinate=pdecon_3.XComponent, YCoordinate=addition_2, ZCoordinate=addition)  # disabled
vec2pt = Vector2Pt(PointA=pt_4, PointB=pt_5, Unitize=False)  # -> Vector, Length; disabled
line = LineSDL(Start=pt_4, Direction=vec2pt.Vector, Length=12000)  # disabled
end = EndPoints(Curve=line)  # -> Start, End; disabled
bridge_width = Slider(4269, range=100..5000)  # disabled
pt_6 = Point(Point(-2817, 496938.7824, -46585.92041))  # disabled
pt_7 = Point(Point(-724, 526864.7824, -46585.92041))  # disabled
pdecon_4 = Deconstruct(Point=pt_7)  # -> XComponent, YComponent, ZComponent; disabled
pdecon_5 = Deconstruct(Point=pt_6)  # -> XComponent, YComponent, ZComponent; disabled
pt_8 = ConstructPoint(XCoordinate=pdecon_4.XComponent, YCoordinate=pdecon_4.YComponent, ZCoordinate=addition)  # disabled
pt_9 = ConstructPoint(XCoordinate=pdecon_5.XComponent, YCoordinate=pdecon_5.YComponent, ZCoordinate=addition)  # disabled
ln = Line(StartPoint=pt_8, EndPoint=end.End)  # disabled
ln_2 = Line(StartPoint=end.End, EndPoint=pt_9)  # disabled
offset_11 = OffsetCurve(Curve=line, Distance=expr("x/2", bridge_width), Plane=PlaneXY(0, 0, 0), Corners=1)  # disabled
offset_12 = OffsetCurve(Curve=line, Distance=expr("x/-2", bridge_width), Plane=PlaneXY(0, 0, 0), Corners=1)  # disabled
offset_13 = OffsetCurve(Curve=ln, Distance=expr("x/2", bridge_width), Plane=PlaneXY(0, 0, 0), Corners=1)  # disabled
offset_14 = OffsetCurve(Curve=ln, Distance=expr("x/-2", bridge_width), Plane=PlaneXY(0, 0, 0), Corners=1)  # disabled
offset_15 = OffsetCurve(Curve=ln_2, Distance=expr("x/2", bridge_width), Plane=PlaneXY(0, 0, 0), Corners=1)  # disabled
offset_16 = OffsetCurve(Curve=ln_2, Distance=expr("x/-2", bridge_width), Plane=PlaneXY(0, 0, 0), Corners=1)  # disabled
loft_6 = Loft(
    Curves=[offset_11, offset_12],
    Options={Adjust=False, Closed=False, LoftEnds=0, LoftSimp=0, LoftType=0, Rebuild=10, Refit=0.01})  # disabled
loft_7 = Loft(
    Curves=[offset_15, offset_16],
    Options={Adjust=False, Closed=False, LoftEnds=0, LoftSimp=0, LoftType=0, Rebuild=10, Refit=0.01})  # disabled
loft_8 = Loft(
    Curves=[offset_13, offset_14],
    Options={Adjust=False, Closed=False, LoftEnds=0, LoftSimp=0, LoftType=0, Rebuild=10, Refit=0.01})  # disabled
runion = RegionUnion(Curves=[loft_6, loft_8, loft_7])  # disabled
bridge_thickness = Panel("500")  # disabled
divide_2 = DivideCurve(Curve=runion, Count=32, Kinks=False)  # -> Points, Tangents, Parameters; disabled
nurbs_2 = NurbsCurve(Vertices=divide_2.Points, Degree=2, Periodic=True)  # -> Curve, Length, Domain; disabled
Z_3 = UnitZ(Factor=bridge_thickness)  # disabled
extr_4 = Extrude(Base=nurbs_2.Curve, Direction=Z_3)  # disabled
cap_3 = CapHoles(Brep=extr_4)  # disabled

# ----
mesh_2 = Mesh(box_maker.meshFaces)  # disabled

# ---- group: Solar Envelope
startingpoints = Point(rot3d_2.Geometry)  # disabled
centerpoint = Point(volume.Centroid)  # disabled
number_slider = Slider(1, range=1..50)  # disabled
vec2pt_2 = Vector2Pt(PointA=startingpoints, PointB=centerpoint, Unitize=False)  # -> Vector, Length; disabled
voxels = Mesh(mesh_2)  # disabled
poi = Point([<point referenced from the Rhino model> x185])  # disabled
guns = GhPythonScript(PoI=poi, SV=vec2pt_2.Vector, Voxels=voxels, maxhits=number_slider)  # -> HitCounts, SolarEnvelope, RemovedVoxels; inputs PoI: list of Point3d, SV: list of Vector3d, Voxels: list of Mesh, maxhits: Int32; disabled
# ---------- guns: Python ----------
import rhinoscriptsyntax as rs
import Rhino.Geometry as rg
import Rhino.Geometry.Intersect as ri

HitVoxels = []
HitCounts = []
SolarEnvelope = []
RemovedVoxels = []

for i in range(0, PoI.Count):
    poi = PoI[i]
    for j in range(0, SV.Count):
        sv = SV[j]
        reverseSV = -sv
        ray = rg.Ray3d(poi, reverseSV)
        for k,voxel in enumerate(Voxels):
            P = ri.Intersection.MeshRay(voxel,ray)
            if P >= 0:
                HitIndice = k
                HitVoxels.append(HitIndice)

for l in range(len(Voxels)):
    sum = 0
    for m in range(len(HitVoxels)):
        hitvoxel = HitVoxels[m]
        if hitvoxel == l:
            sum += 1
    HitCounts.append(sum)

for n in range(len(HitCounts)):
    if HitCounts[n] < maxhits:
        SolarEnvelope.append(Voxels[n])
    else:
        RemovedVoxels.append(Voxels[n])
# ---------- end guns ----------
number_slider_2 = Slider(3, range=0..20)  # disabled
poipark = Point([<point referenced from the Rhino model> x16])  # disabled
voxels_2 = Mesh(guns.SolarEnvelope)  # disabled
guns_2 = GhPythonScript(PoI=poipark, SV=vec2pt_2.Vector, Voxels=voxels_2, maxhits=number_slider_2)  # -> HitCounts, SolarEnvelope, RemovedVoxels; inputs PoI: list of Point3d, SV: list of Vector3d, Voxels: list of Mesh, maxhits: Int32; disabled; same code as guns

# ----
num_2 = Number(guns.HitCounts)  # disabled

# ---- group: Solar Envelope / Colours
bnd = Bounds(Numbers=num_2)  # disabled
dedomain = DeconstructDomain(Domain=bnd)  # -> Start, End; disabled
gradient = Gradient(
    LowerLimit=dedomain.End,
    UpperLimit=dedomain.Start,
    Parameter=num_2,
    stops=[0: RGB(234, 38, 0), 0.25: RGB(234, 126, 0), 0.5: RGB(254, 244, 84), 0.75: RGB(173, 203, 249), 1: RGB(75, 107, 169)])  # disabled
material = CreateMaterial(Diffuse=gradient, Specular=RGB(255, 255, 255), Emission=RGB(0, 0, 0), Transparency=0, Shine=0)  # disabled
preview = CustomPreview(Geometry=voxels, Material=material)  # disabled

# ----
mesh_3 = Mesh(guns_2.SolarEnvelope)  # disabled

# ---- group: small voxels / mesh to brep
faceb = FaceBoundaries(Mesh=mesh_3)  # disabled
boundary_4 = BoundarySurfaces(Edges=faceb)  # disabled
join = BrepJoin(Breps=boundary_4)  # -> Breps, Closed; disabled

# ---- group: small voxels
x_size_small = Number(4000)  # disabled
y_size_small = Number(4000)  # disabled
z_size_small = Number(3240)  # disabled
xs_2 = Number(x_size_small)  # disabled
ys_2 = Number(y_size_small)  # disabled
zs_2 = Number(z_size_small)  # disabled
brep_2 = Brep(join.Breps)  # disabled
voxelization_2 = PythonScript(S=brep_2, xS=xs_2, yS=ys_2, zS=zs_2)  # -> temp, out, a, b, c, flatten(PntList); inputs S: Brep; disabled
# ---------- voxelization_2: Python ----------
import Rhino.Geometry as rg
import math as math
import scriptcontext as sc

#Find the bounding box of the brep in question
Bbox = S.GetBoundingBox(True)

#Find the Length, Width, and Height of the bounding boz of the Brep
W = Bbox.Diagonal.X
L = Bbox.Diagonal.Y
H = Bbox.Diagonal.Z

#Divide the 3 axis of the bounding box by the dimensions of the voxel
#This will give you a U, V, W value along the bounding box
#Turn this value into an integer by finding the next biggest integer (roundingUp)
UC = int(math.ceil(W/xS))
VC = int(math.ceil(L/yS))
WC = int(math.ceil(H/zS))

#Create a container for you Point List
#Create a container for your distance List
Point_list = []
Distance_list = []

#Create a base Plane for all the geometry 
Baseplane = rg.Plane(Bbox.Min, rg.Vector3d.XAxis, rg.Vector3d.YAxis)


#Due to the fact that all voxels are based on the center points, we need
#to create a shift towards the voxel's center, which is half of each dimension
xShift = xS*0.5
yShift = yS*0.5
zShift = zS*0.5

#Write a for-loop that itereates through all U, V, W values of the bounding box
#Create a point with consideration of the half shift at each U, V, W locaiton
#Store this point in the point list
#Create a 'closest point; from the brep to the point at the U,V,W value 
#find the distance of the point in the u, v ,w address to the closet point on the brep
#if the point is inside the brep, give it a negative value
#save distances to list
#out put both lists
for i in range(0,UC):
    for j in range (0,VC):
        for k in range (0,WC):
            point = Baseplane.PointAt(xShift +i * xS, yShift + j * yS, zShift + k * zS)
            if (S.IsPointInside(point,0.05,True)):
                Point_list.append(point)

PntList = Point_list
c = Distance_list
# ---------- end voxelization_2 ----------

# ---- group: Graphmaker
pdecon_6 = Deconstruct(Point=voxelization_2.PntList)  # -> XComponent, YComponent, ZComponent; disabled
panel_9 = Panel("0")  # disabled
num_3 = Number(pdecon_6.XComponent)  # disabled
num_4 = Number(pdecon_6.YComponent)  # disabled
num_5 = Number(pdecon_6.ZComponent)  # disabled
item = ListItem(List=num_3, Index=panel_9, Wrap=True)  # disabled
item_2 = ListItem(List=num_4, Index=panel_9, Wrap=True)  # disabled
item_3 = ListItem(List=num_5, Index=panel_9, Wrap=True)  # disabled
subtraction_2 = Subtraction(A=num_3, B=item)  # disabled
subtraction_3 = Subtraction(A=num_4, B=item_2)  # disabled
subtraction_4 = Subtraction(A=num_5, B=item_3)  # disabled
int = Integer(subtraction_3)  # disabled
int_2 = Integer(subtraction_2)  # disabled
int_3 = Integer(subtraction_4)  # disabled
division = Division(A=int_2, B=x_size_small)  # disabled
division_2 = Division(A=int, B=y_size_small)  # disabled
division_3 = Division(A=int_3, B=z_size_small)  # disabled

# ---- group: points and indices
bbox = BoundingBox(Content=mesh_2, Plane=PlaneXY(0, 0, 0), UnionBox=True)  # -> Box, Box_2; disabled
xs_3 = Number(x_size_large)  # disabled
ys_3 = Number(y_size_large)  # disabled
brep_3 = Brep(bbox.Box)  # disabled
zs_3 = Number(z_size_large)  # disabled
voxelization_3 = PythonScript(S=brep_3, xS=xs_3, yS=ys_3, zS=zs_3)  # -> temp, out, a, b, c, PntList; inputs S: Brep; disabled; same code as voxelization
box_maker_2 = GhPythonScript(centerPoint=voxelization_3.PntList, BoxSpanX=xs_3, BoxSpanY=ys_3, BoxSpanZ=zs_3)  # -> out, meshFaces, a, b, temp; inputs centerPoint: Point3d; disabled; same code as box_maker
faceb_2 = FaceBoundaries(Mesh=box_maker_2.meshFaces)  # disabled
boundary_5 = BoundarySurfaces(Edges=faceb_2)  # disabled
join_2 = BrepJoin(Breps=boundary_5)  # -> Breps, Closed; disabled
brep_4 = Brep(flatten(join_2.Breps))  # disabled
xs_4 = Number(x_size_small)  # disabled
ys_4 = Number(y_size_small)  # disabled
zs_4 = Number(z_size_small)  # disabled
voxelization_4 = PythonScript(S=brep_4, xS=xs_4, yS=ys_4, zS=zs_4)  # -> temp, flatten(PntList); inputs S: Brep; disabled
# ---------- voxelization_4: Python ----------
import Rhino.Geometry as rg
import math as math
import scriptcontext as sc

#Find the bounding box of the brep in question
Bbox = S.GetBoundingBox(True)

#Find the Length, Width, and Height of the bounding box of the Brep
W = Bbox.Diagonal.X
L = Bbox.Diagonal.Y
H = Bbox.Diagonal.Z

#Divide the 3 axis of the bounding box by the dimensions of the voxel
#This will give you a U, V, W value along the bounding box
#Turn this value into an integer by finding the next biggest integer (roundingUp)
UC = int(math.ceil(W/xS))
VC = int(math.ceil(L/yS))
WC = int(math.ceil(H/zS))

#Create a container for your Point List
#Create a container for your distance List
#Create a container for your integer points List
Point_list = []
Distance_list = []
Intpoints_listX = []
Intpoints_listY = []
Intpoints_listZ = []

#Create a base Plane for all the geometry 
Baseplane = rg.Plane(Bbox.Min, rg.Vector3d.XAxis, rg.Vector3d.YAxis)


#Due to the fact that all voxels are based on the center points, we need
#to create a shift towards the voxel's center, which is half of each dimension
xShift = xS*0.5
yShift = yS*0.5
zShift = zS*0.5

#Write a for-loop that itereates through all U, V, W values of the bounding box
#Create a point with consideration of the half shift at each U, V, W locaiton
#Store this point in the point list
#Create a 'closest point; from the brep to the point at the U,V,W value 
#find the distance of the point in the u, v ,w address to the closet point on the brep
#if the point is inside the brep, give it a negative value
#save distances to list
#out put both lists
for i in range(0,UC):
    for j in range (0,VC):
        for k in range (0,WC):
            point = Baseplane.PointAt(xShift +i * xS, yShift + j * yS, zShift + k * zS)
            if (S.IsPointInside(point,0.05,True)):
                Point_list.append(point)
                Intpoints_listX.append(i)
                Intpoints_listY.append(j)
                Intpoints_listZ.append(k)

# nieuwe Brep = rg.Brep.Join(
# grote bounding box maken
PntList = Point_list
X = Intpoints_listX
Y = Intpoints_listY
Z = Intpoints_listZ
# ---------- end voxelization_4 ----------
solarenvelope = Brep(flatten(join.Breps))  # disabled
reconstruct_pointcloud = GhPythonScript(all_points=voxelization_4.PntList, breps=solarenvelope)  # -> flatten(all_points), flatten(removed_points), flatten(removed_indices); inputs all_points: list of Point3d, breps: list of Brep; disabled
# ---------- reconstruct_pointcloud: Python ----------
__author__ = "maxke"
__version__ = "2019.01.11"

import rhinoscriptsyntax as rs
import Rhino.Geometry as rg

P = all_points
B = breps

AllPoints = P
AllIndices = []
PointsRemoved = []
PointsRemaining = []
RemovedIndices = []
RemainingIndices = []

for i in range(len(P)):
    point = rg.Point3d(P[i])
    n = 0
    for j in range(len(B)):
        if n == 0:
            if (B[j].IsPointInside(point,0.05,True)):
                PointsRemoved.append(point)
                RemovedIndices.append(i)
                n = n+1
    if n == 0:
        PointsRemaining.append(point)
        RemainingIndices.append(i)
    AllIndices.append(i)

removed_points = PointsRemaining
remaining_points = PointsRemoved
removed_indices = RemainingIndices
remaining_indices = RemovedIndices
all_points = AllPoints
all_indices = AllIndices
# ---------- end reconstruct_pointcloud ----------

# ---- group: grid
realcoordinates = Point(voxelization_2.PntList)  # disabled
x_grid = Number(division)  # disabled
z_grid = Number(division_3)  # disabled
y_grid = Number(division_2)  # disabled

# ----
graphmaker = Graphmaker(points=reconstruct_pointcloud.all_points, x_size=x_size_small, y_size=y_size_small, z_size=z_size_small)  # -> x_grid_2, y_grid_2, z_grid_2; disabled
graphmaker_2 = Graphmaker(points=reconstruct_pointcloud.removed_points, x_size=x_size_small, y_size=y_size_small, z_size=z_size_small)  # -> x_grid_2, y_grid_2, z_grid_2; disabled
pt_10 = ConstructPoint(XCoordinate=graphmaker_2.x_grid_2, YCoordinate=graphmaker_2.y_grid_2, ZCoordinate=graphmaker_2.z_grid_2)  # disabled

# ---- group: Center points
# Center Points: Select a point in Rhino and grasshopper automatically gets the corresponding point in the pointcloud.
pt_11 = Point(realcoordinates)  # disabled
cp = ClosestPoint(Point=startercenter, Cloud=pt_11)  # -> ClosestPoint, CPIndex, Distance; disabled
cp_2 = ClosestPoint(Point=gymcenter, Cloud=pt_11)  # -> ClosestPoint, CPIndex, Distance; disabled
cp_3 = ClosestPoint(Point=assistedcenter, Cloud=pt_11)  # -> ClosestPoint, CPIndex, Distance; disabled
cp_4 = ClosestPoint(Point=cinamacenter, Cloud=pt_11)  # -> ClosestPoint, CPIndex, Distance; disabled
cp_5 = ClosestPoint(Point=studentcenter, Cloud=pt_11)  # -> ClosestPoint, CPIndex, Distance; disabled
cp_6 = ClosestPoint(Point=restaurantcenter, Cloud=pt_11)  # -> ClosestPoint, CPIndex, Distance; disabled
cp_7 = ClosestPoint(Point=atriumcenter, Cloud=pt_11)  # -> ClosestPoint, CPIndex, Distance; disabled
cp_8 = ClosestPoint(Point=workspacecenter, Cloud=pt_11)  # -> ClosestPoint, CPIndex, Distance; disabled
cp_9 = ClosestPoint(Point=supermarketcenter, Cloud=pt_11)  # -> ClosestPoint, CPIndex, Distance; disabled

# ----
points = PointList(Points=pt_11)  # disabled

# ---- group: Start & End point
pt_12 = ConstructPoint(XCoordinate=graphmaker.x_grid_2, YCoordinate=graphmaker.y_grid_2, ZCoordinate=graphmaker.z_grid_2)  # disabled
graph = ListItem(List=pt_12, Index=starting_index, Wrap=True)  # disabled
building = ListItem(List=reconstruct_pointcloud.all_points, Index=starting_index, Wrap=True)  # disabled
graph_2 = ListItem(List=pt_12, Index=end_index, Wrap=True)  # disabled
building_2 = ListItem(List=reconstruct_pointcloud.all_points, Index=end_index, Wrap=True)  # disabled

# ---- group: grid
z_grid_2 = Number(graphmaker_2.z_grid_2)  # disabled
x_grid_2 = Number(graphmaker_2.x_grid_2)  # disabled
y_grid_2 = Number(graphmaker_2.y_grid_2)  # disabled
sort = SortList(Keys=x_grid_2)  # -> Keys, ValuesA; disabled
sort_2 = SortList(Keys=y_grid_2)  # -> Keys, ValuesA; disabled
sort_3 = SortList(Keys=z_grid_2)  # -> Keys, ValuesA; disabled
rev = ReverseList(List=sort.Keys)  # disabled
rev_2 = ReverseList(List=sort_2.Keys)  # disabled
rev_3 = ReverseList(List=sort_3.Keys)  # disabled
item_4 = ListItem(List=rev, Index=0, Wrap=True)  # disabled
item_5 = ListItem(List=rev_2, Index=0, Wrap=True)  # disabled
item_6 = ListItem(List=rev_3, Index=0, Wrap=True)  # disabled
num_6 = Number(1)  # disabled
addition_3 = Addition(A=item_4, B=num_6)  # disabled
addition_4 = Addition(A=item_5, B=num_6)  # disabled
# CONFIGURING
addition_5 = Addition(A=item_6, B=num_6)  # disabled

# ---- group: Pathfinding
applied_a_star_algorithm = GhPythonScript(
    All_Points=pt_12,
    Start_Points=graph,
    End_Points=graph_2,
    Removed_Points=pt_10,
    X_Count=addition_3,
    Y_Count=addition_4,
    Z_Count=addition_5)  # -> out, path, PathIndices; inputs All_Points: list of Point3d, Start_Points: Point3d, End_Points: Point3d, Removed_Points: list of Point3d, X_Count: Int32, Y_Count: Int32, Z_Count: Int32; disabled
# ---------- applied_a_star_algorithm: Python ----------
__author__ = "maxke"
__version__ = "2019.01.14"

import rhinoscriptsyntax as rs
import Rhino.Geometry as rg
import math
import random as rd
import heapq

# A* algorithm and classes/definitions
# from: https://www.redblobgames.com/pathfinding/a-star/implementation.html
# (A* algorithm is closer to uniform cost search)
# in bounds, passable, tup_p3d definitions inspired by viktor's work

class PriorityQueue:
    def __init__(self):
        self.elements = []
    
    def empty(self):
        return len(self.elements) == 0
    
    def put(self, item, priority):
        heapq.heappush(self.elements, (priority, item))
    
    def get(self):
        return heapq.heappop(self.elements)[1]

#cartesian distance
def heuristic(a, b):
    (x1, y1, z1) = a
    (x2, y2, z2) = b
    return math.sqrt(abs(x1 - x2)**2 + abs(y1 - y2)**2)

#To quickly convert a tuples of point into a rhino geometry Points3d
def tup_p3d(tuples):
    return rg.Point3d(tuples[0],tuples[1],tuples[2])

#Transforms a point3d into xyz values
def Point_to_XYZ(points):
    XYZ = points.X,points.Y,points.Z
    return XYZ

def a_star_search(graph, start, goal):
    frontier = PriorityQueue()
    frontier.put(start, 0)
    came_from = {}
    cost_so_far = {}
    came_from[start] = None
    cost_so_far[start] = 0
    while not frontier.empty():
        current = frontier.get()
        if current == goal:
            break
        travel_id = (0,0,3)
        for next in graph.neighbors(current,(travel_id)):
            new_cost = cost_so_far[current]
            if next not in cost_so_far or new_cost < cost_so_far[next]:
                cost_so_far[next] = new_cost
                priority = new_cost + heuristic(goal, next)
                frontier.put(next, priority)
                came_from[next] = current
    return came_from

#appends the shortest found path
def reconstruct_path(came_from, start, goal):
    current = goal
    path = []
    if current in came_from:
        while current != start:
            path.append(current)
            current = came_from[current]
        path.append(start) # optional
        path.reverse() # optional
    else:
        print "no", current, "in came_from"
    return path 

#returns the actual indices of the shortest path
def find_indices(path, points):
    indices = []
    for i in range (len(path)):
        spheres = rg.Brep.CreateFromSphere(rg.Sphere(path[i],1))
        for j in range (len(points)):
            CheckPoint = points[j]
            if rg.Brep.IsPointInside(spheres,CheckPoint,0.1,True):
                indices.append(j)
    return indices

#creates a grid on the origin with the sane voxel count as the total grid in reality has
#checks if the points considered for the path are actually usable
class SquareGrid:
    def __init__(self, width, depth, height, walls):
        self.width = width
        self.depth = depth
        self.height = height
        self.walls = walls
    
    def in_bounds(self, id):
        (x,y,z) = id
        return 0 <= x < self.width and 0 <= y < self.height and 0 <= z < self.height
    
    def passable(self, id):
        return id not in self.walls
    
    def neighbors(self, id, (xi, yi, zi)):
        (x,y,z) = id
        results = []
        if xi == 0:
            results.append((x+1, y, z))
            results.append((x-1, y, z))
        elif xi == 1:
            results.append((x+1, y, z))
        elif xi == 2:
            results.append((x-1, y, z))
            
        if yi == 0:
            results.append((x, y+1, z))
            results.append((x, y-1, z))
        elif yi == 1:
            results.append((x, y+1, z))
        elif yi == 2:
            results.append((x, y-1, z))
        
        if zi == 0:
            results.append((x, y, z+1))
            results.append((x, y, z-1))
        elif zi == 1:
            results.append((x, y, z+1))
        elif zi == 2:
            results.append((x, y, z-1))
        results = filter(self.in_bounds, results)
        results = filter(self.passable, results)
        return results


XP = Removed_Points
XI = Removed_Indices
SP = Start_Points
EP = End_Points
W = X_Count
D = Y_Count
H = Z_Count
AP = AllPoints

coordinates = {}
total_paths = 1 #nr of paths

RemovedPoints = []
for j in range (len(XP)):
    NewPoints = int(XP[j].X),int(XP[j].Y),int(XP[j].Z)
    RemovedPoints.append(NewPoints)
g = SquareGrid(W,D,H,RemovedPoints)

start = Point_to_XYZ(SP)
goal = Point_to_XYZ(EP)

#calling the search
Path_Points = []
came_from = a_star_search(g, start, goal)
r_p = reconstruct_path(came_from, start, goal)
for i in r_p:
    coord = i
    Path_Points.append(tup_p3d(coord))

PathIndices = find_indices(Path_Points,AP)
path = Path_Points
# ---------- end applied_a_star_algorithm ----------
pt_13 = Point(applied_a_star_algorithm.path)  # disabled
all_points = Point(reconstruct_pointcloud.all_points)  # disabled
item_7 = ListItem(List=all_points, Index=applied_a_star_algorithm.PathIndices, Wrap=True)  # disabled
pt_14 = Point(item_7)  # disabled

# ----
pt_15 = Point(realcoordinates)  # disabled
points_shadow = Point(pt_15)  # disabled
points_sound = Point(pt_15)  # disabled
# MASSING
pt_16 = Point(realcoordinates)  # disabled

# ---- group: Shadow analysis
facade_edge = Curve(<curve referenced from the Rhino model>)  # disabled
rail = Curve(<curve referenced from the Rhino model>)  # disabled
arrcurve = CurveArray(Geometry=facade_edge, Curve=rail, Count=20)  # -> Geometry, Transform; disabled
pull = PullPoint(Point=points_shadow, Geometry=arrcurve.Geometry, ClosestOnly=True)  # -> ClosestPoint, Distance; disabled
environment = Mesh([<mesh referenced from the Rhino model> x20])  # disabled
mjoin = MeshJoin(Meshes=environment)  # disabled
shadow_analysis = GhPythonScript(PoI=points_shadow, SV=vec2pt_2.Vector, Environment=mjoin, Distances=pull.Distance)  # -> ShadowValues; inputs PoI: list of Point3d, SV: list of Vector3d, Environment: Mesh, Distances: list; disabled
# ---------- shadow_analysis: Python ----------
import rhinoscriptsyntax as rs
import Rhino.Geometry as rg
import Rhino.Geometry.Intersect as ri

points = []
lines = []
sums = []
NormalizedValues = []
ShadowValues = []

#Calculating shadowvalue of all the voxels using reversed solar rays
for i in PoI:
    sum = 0
    for j in SV:
        reverseSV = -j
        ray = rg.Ray3d(i, reverseSV)
        P = ri.Intersection.MeshRay(Environment,ray)
        if P > 0:
            sum = sum + 1
    sums.append(sum)

#normalizing the values (0.0 to 1.0)
highestvalue = max(sums)
for j in range(len(sums)):
    normalizedvalue = sums[j]/highestvalue
    NormalizedValues.append(normalizedvalue)

#making sure the heart of the building receives no direct sunlight
for m in range(0,len(Distances)):
    if (Distances[m] > 11000):
        NormalizedValues[m] = 1
    if (7000 < Distances[m] < 11000):
        NormalizedValues[m] = 0.9 
    if (6000 < Distances[m] < 7000):
        NormalizedValues[m] = 0.7 
    ShadowValues.append(NormalizedValues[m])
# ---------- end shadow_analysis ----------
value = Number(shadow_analysis)  # disabled

# ---- group: Sound analysis
streetsource = Curve(<curve referenced from the Rhino model>)  # disabled
trainsource = Point(Point(-76138.08055, 360137.7824, -46585.92041))  # disabled
pull_2 = PullPoint(Point=points_sound, Geometry=streetsource, ClosestOnly=True)  # -> ClosestPoint, Distance; disabled
pull_3 = PullPoint(Point=points_sound, Geometry=trainsource, ClosestOnly=True)  # -> ClosestPoint, Distance; disabled
sound_analysis = GhPythonScript(RoadDistances=pull_2.Distance, TrainDistances=pull_3.Distance)  # -> SoundValues; inputs RoadDistances: list, TrainDistances: list; disabled
# ---------- sound_analysis: Python ----------
import rhinoscriptsyntax as rs
import Rhino.Geometry as rg
import Rhino.Geometry.Intersect as ri

sums = []
SoundValues = []

#adding the two values together (with weights)
for i in range(len(RoadDistances)):
    RoadDistances[i] = 0.3*RoadDistances[i]+1.0*TrainDistances[i]
    sums.append(RoadDistances[i])

#normalizing the values (0.0 to 1.0)
lowestvalue = min(sums)
highestvalue = max(sums) - lowestvalue
for j in range(len(sums)):
    normalizedvalue = (sums[j]-lowestvalue)/highestvalue
    SoundValues.append(normalizedvalue)
# ---------- end sound_analysis ----------
value_2 = Number(sound_analysis)  # disabled

# ----
num_7 = Number(value_2)  # disabled
num_8 = Number(value)  # disabled

# ---- group: growing
int_4 = Integer(2)  # disabled
growing_algorithm = GH_CPython(
    input=int_4,
    p=percentage,
    firstAtriumIndex=cp_7.CPIndex,
    firstStudenthousingIndex=cp_5.CPIndex,
    firstAssistedhousingIndex=cp_3.CPIndex,
    firstStarterhousingIndex=cp.CPIndex,
    firstWorkspaceIndex=cp_8.CPIndex,
    firstRestaurantIndex=cp_6.CPIndex,
    firstCinemaIndex=cp_4.CPIndex,
    firstGymIndex=cp_2.CPIndex,
    firstSupermarketIndex=cp_9.CPIndex,
    xcoordinates=x_grid,
    ycoordinates=y_grid,
    zcoordinates=z_grid,
    shadowvalues=value,
    noisevalues=value_2)  # -> output, indicesAtrium, indicesStudenthousing, indicesAssistedhousing, indicesStarterhousing, indicesWorkspacefunctions, indicesRestaurantfunctions, indicesCinemafunctions, indicesGymfunctions, indicesSupermarketfunctions; inputs input: list, p: list, firstAtriumIndex: list, firstStudenthousingIndex: list, firstAssistedhousingIndex: list, firstStarterhousingIndex: list, firstWorkspaceIndex: list, firstRestaurantIndex: list, firstCinemaIndex: list, firstGymIndex: list, firstSupermarketIndex: list, xcoordinates: list, ycoordinates: list, zcoordinates: list, shadowvalues: list, noisevalues: list; disabled
#   port input: [required] - [type = int] - [default = None] Descripe your input here * bullet point. * bullet point
#   port output: indicate your output description here. refers to a new line.
# ---------- growing_algorithm: Python ----------
import pandas as pd
import numpy as np

numberofVoxels = len(xcoordinates)
counter = 10  #10 starting points of the functions are already given

#defining the caracteristics of each function
maxSurfaceAtrium = p*480 / 16
maxShadowValueAtrium = 1
minNoiseValueAtrium = 0

maxSurfaceStudenthousing = p*2000 / 16
maxShadowValueStudenthousing = 1
minNoiseValueStudenthousing = 0.07

maxSurfaceAssistedhousing = p*1180 / 16
maxShadowValueAssistedhousing = 1
minNoiseValueAssistedhousing = 0.75

maxSurfaceStarterhousing = p*3180 / 16
maxShadowValueStarterhousing = 1
minNoiseValueStarterhousing = 0.372

maxSurfaceWorkspace = p*600 / 16
maxShadowValueWorkspace = 1
minNoiseValueWorkspace = 0.3

maxSurfaceRestaurant = p*152 / 16
maxShadowValueRestaurant = 1
minNoiseValueRestaurant = 0

maxSurfaceCinema = p*90 / 16
maxShadowValueCinema = 1
minNoiseValueCinema = 0

maxSurfaceGym = p*144 / 16
maxShadowValueGym = 1
minNoiseValueGym = 0

maxSurfaceSupermarket = p*300 / 16
maxShadowValueSupermarket = 1
minNoiseValueSupermarket = 0

#0=function has not yet reached the maximum surface; 1=function has reached the maximum surface OR there aren't any available voxels anymore
atriumFull = 0
studenthousingFull = 0
assistedhousingFull = 0
starterhousingFull = 0
workspaceFull = 0
restaurantFull = 0
cinemaFull = 0
gymFull = 0
supermarketFull = 0

#creating the dataframe with colums for the coordinates, shadowvalues, noisevalues and function of each point in the pointcloud
df = pd.DataFrame({'x': xcoordinates, 'y': ycoordinates, 'z': zcoordinates, 'shadowvalues': shadowvalues, 'noisevalues': noisevalues, 'functions': -1})
#setting the label in the 'function' column to the corresponding number for all the starting points
df.loc[firstAtriumIndex, 'functions'] = 0 #Atrium = 0
for j in df.index[df.functions == 0].values:
    acceptedcandidates_z = df[(df.x == df.loc[j, 'x']) & (df.y == df.loc[j, 'y'])]
    df.loc[acceptedcandidates_z.index.values, 'functions'] = 0 #all voxels above the starting point of the atrium should also be included because the atrium will reach to the top of the building
df.loc[firstStudenthousingIndex, 'functions'] = 1 #studenthousing = 1
df.loc[firstAssistedhousingIndex, 'functions'] = 2 #assistedhousing = 2
df.loc[firstStarterhousingIndex, 'functions'] = 3 #starterhousing = 3
df.loc[firstWorkspaceIndex, 'functions'] = 4 #workspace = 4
for j in df.index[df.functions == 4].values:
    acceptedcandidates_z = df[(df.x == df.loc[j, 'x']) & (df.y == df.loc[j, 'y']) & (df.z == (df.loc[j, 'z']+1))]
    df.loc[acceptedcandidates_z.index.values, 'functions'] = 4 #for evey point set to a public function, the point direct above it should also be included as all the public functions will have a double height ceiling
df.loc[firstRestaurantIndex, 'functions'] = 5 #restaurant = 5
for j in df.index[df.functions == 5].values:
    acceptedcandidates_z = df[(df.x == df.loc[j, 'x']) & (df.y == df.loc[j, 'y']) & (df.z == (df.loc[j, 'z']+1))]
    df.loc[acceptedcandidates_z.index.values, 'functions'] = 5
df.loc[firstCinemaIndex, 'functions'] = 6 #cinema = 6
for j in df.index[df.functions == 6].values:
    acceptedcandidates_z = df[(df.x == df.loc[j, 'x']) & (df.y == df.loc[j, 'y']) & (df.z == (df.loc[j, 'z']+1))]
    df.loc[acceptedcandidates_z.index.values, 'functions'] = 6
df.loc[firstGymIndex, 'functions'] = 7 #gym = 7
for j in df.index[df.functions == 7].values:
    acceptedcandidates_z = df[(df.x == df.loc[j, 'x']) & (df.y == df.loc[j, 'y']) & (df.z == (df.loc[j, 'z']+1))]
    df.loc[acceptedcandidates_z.index.values, 'functions'] = 7
df.loc[firstSupermarketIndex, 'functions'] = 8 #supermarket = 8
for j in df.index[df.functions == 8].values:
    acceptedcandidates_z = df[(df.x == df.loc[j, 'x']) & (df.y == df.loc[j, 'y']) & (df.z == (df.loc[j, 'z']+1))]
    df.loc[acceptedcandidates_z.index.values, 'functions'] = 8

#following while loop will loop through every growing function untill there are no more points left over in the building OR untill all the maximum surfaces of the functions have been reached
while (counter < numberofVoxels) & (atriumFull*studenthousingFull*assistedhousingFull*starterhousingFull*workspaceFull*restaurantFull*cinemaFull*gymFull*supermarketFull == 0):
    #every function will loop through the current function points, find the available neighbours, check if they have the minimum required noisevalue, and from the leftover options select the points that are closest in distance to a sunlit area and to another function given the network from the graph relaxation

    if (len(df[df.functions == 0]) / 7) < maxSurfaceAtrium:
        countaccepted = 0
        atriumPoints = df[df.functions == 0]
        atriumIndices = atriumPoints.index[atriumPoints.z == 0].values
        for i in atriumIndices: 
            xneighbours = df[((df.x == (df.loc[i, 'x'] + 1)) | (df.x == (df.loc[i, 'x'] - 1))) & (df.y == (df.loc[i, 'y'])) & (df.z == (df.loc[i, 'z']))]
            yneighbours = df[((df.y == (df.loc[i, 'y'] + 1)) | (df.y == (df.loc[i, 'y'] - 1))) & (df.x == (df.loc[i, 'x'])) & (df.z == (df.loc[i, 'z']))]
            neighbours = pd.concat([xneighbours, yneighbours])
            candidates = neighbours[neighbours.functions == -1]
            acceptedCandidates = candidates[(candidates.shadowvalues <= maxShadowValueAtrium) & (candidates.noisevalues >= minNoiseValueAtrium)]
            #select the point that is closest to the other side of the building, that way, the atrium will have a better chance at connecting all the functions of the building
            mindist = 1000
            closestCandidate = firstAtriumIndex
            mindist2 = 1000
            closestCandidate2 = firstAtriumIndex
            for k in acceptedCandidates.index.values: 
                dist = np.sqrt((df.loc[k, 'x'] - df.loc[127, 'x'])**2 + (df.loc[k, 'y'] - df.loc[127, 'y'])**2) 
                if dist < mindist:
                    mindist = dist
                    closestCandidate = k
                dist2 = np.sqrt((df.loc[k, 'x'] - df.loc[213, 'x'])**2 + (df.loc[k, 'y'] - df.loc[213, 'y'])**2) 
                if dist2 < mindist2:
                    mindist2 = dist2
                    closestCandidate2 = k
            df.loc[[closestCandidate, closestCandidate2], 'functions'] = 0
            for j in [closestCandidate, closestCandidate2]:
                closestCandidate_z = df[(df.x == df.loc[j, 'x']) & (df.y == df.loc[j, 'y'])]
                df.loc[closestCandidate_z.index.values, 'functions'] = 0
            df.loc[closestCandidate_z.index.values, 'functions'] = 0
            countaccepted = countaccepted + len(acceptedCandidates)
        if countaccepted == 0: #if there are no more available neighbours found: print an error that mentions this and set the value of atriumFull to 1
            atriumFull = 1
            print('growing atrium was interrupted because no acceptable voxels found')
    if (len(df[df.functions == 0]) / 7) >= maxSurfaceAtrium: #if the maximum surface of the atrium is reached: set the value of atriumFull to 1
        atriumFull = 1

    
    if len(df[df.functions == 1]) < maxSurfaceStudenthousing:
        countaccepted = 0
        studenthousingIndices = df.index[df.functions == 1].values
        for i in studenthousingIndices: 
            xneighbours = df[((df.x == (df.loc[i, 'x'] + 1)) | (df.x == (df.loc[i, 'x'] - 1))) & (df.y == (df.loc[i, 'y'])) & (df.z == (df.loc[i, 'z']))]
            yneighbours = df[((df.y == (df.loc[i, 'y'] + 1)) | (df.y == (df.loc[i, 'y'] - 1))) & (df.x == (df.loc[i, 'x'])) & (df.z == (df.loc[i, 'z']))]
            zneighbours = df[((df.z == (df.loc[i, 'z'] + 1)) | (df.z == (df.loc[i, 'z'] - 1))) & (df.y == (df.loc[i, 'y'])) & (df.x == (df.loc[i, 'x']))]
            neighbours = pd.concat([xneighbours, yneighbours, zneighbours])
            candidates = neighbours[neighbours.functions == -1]
            acceptedCandidates = candidates[(candidates.shadowvalues <= maxShadowValueStudenthousing) & (candidates.noisevalues >= minNoiseValueStudenthousing)]
            #select the point that is closest to the atrium so that all functions will grow around the atrium and give the best possible network in the building
            mindist = 1000
            closestCandidate = firstStudenthousingIndex
            for k in acceptedCandidates.index.values: 
                dist = np.sqrt((df.loc[k, 'x'] - df.loc[firstAtriumIndex, 'x'])**2 + (df.loc[k, 'y'] - df.loc[firstAtriumIndex, 'y'])**2)
                if dist < mindist:
                    mindist = dist
                    closestCandidate = k
            df.loc[closestCandidate, 'functions'] = 1
            countaccepted = countaccepted + len(acceptedCandidates)
        if countaccepted == 0:
            studenthousingFull = 1
            print('growing studenthousing was interrupted because no acceptable voxels found')
    if len(df[df.functions == 1]) >= maxSurfaceStudenthousing:
        studenthousingFull = 1


    if len(df[df.functions == 2]) < maxSurfaceAssistedhousing:
        countaccepted = 0
        assistedhousingIndices = df.index[df.functions == 2].values
        for i in assistedhousingIndices: 
            xneighbours = df[((df.x == (df.loc[i, 'x'] + 1)) | (df.x == (df.loc[i, 'x'] - 1))) & (df.y == (df.loc[i, 'y'])) & (df.z == (df.loc[i, 'z']))]
            yneighbours = df[((df.y == (df.loc[i, 'y'] + 1)) | (df.y == (df.loc[i, 'y'] - 1))) & (df.x == (df.loc[i, 'x'])) & (df.z == (df.loc[i, 'z']))]
            zneighbours = df[((df.z == (df.loc[i, 'z'] + 1)) | (df.z == (df.loc[i, 'z'] - 1))) & (df.y == (df.loc[i, 'y'])) & (df.x == (df.loc[i, 'x']))]
            neighbours = pd.concat([xneighbours, yneighbours, zneighbours])
            candidates = neighbours[neighbours.functions == -1]
            acceptedCandidates = candidates[(candidates.shadowvalues <= maxShadowValueAssistedhousing) & (candidates.noisevalues >= minNoiseValueAssistedhousing)]
            mindist = 1000
            closestCandidate = firstAssistedhousingIndex
            for k in acceptedCandidates.index.values:
                dist = np.sqrt((df.loc[k, 'x'] - df.loc[firstAtriumIndex, 'x'])**2 + (df.loc[k, 'y'] - df.loc[firstAtriumIndex, 'y'])**2)
                if dist < mindist:
                    mindist = dist
                    closestCandidate = k
            df.loc[closestCandidate, 'functions'] = 2
            countaccepted = countaccepted + len(acceptedCandidates)
        if countaccepted == 0:
            assistedhousingFull = 1
            print('growing assistedhousing was interrupted because no acceptable voxels found')
    if len(df[df.functions == 2]) >= maxSurfaceAssistedhousing:
        assistedhousingFull = 1


    if len(df[df.functions == 3]) < maxSurfaceStarterhousing:
        countaccepted = 0
        starterhousingIndices = df.index[df.functions == 3].values
        for i in starterhousingIndices: 
            xneighbours = df[((df.x == (df.loc[i, 'x'] + 1)) | (df.x == (df.loc[i, 'x'] - 1))) & (df.y == (df.loc[i, 'y'])) & (df.z == (df.loc[i, 'z']))]
            yneighbours = df[((df.y == (df.loc[i, 'y'] + 1)) | (df.y == (df.loc[i, 'y'] - 1))) & (df.x == (df.loc[i, 'x'])) & (df.z == (df.loc[i, 'z']))]
            zneighbours = df[((df.z == (df.loc[i, 'z'] + 1)) | (df.z == (df.loc[i, 'z'] - 1))) & (df.y == (df.loc[i, 'y'])) & (df.x == (df.loc[i, 'x']))]
            neighbours = pd.concat([xneighbours, yneighbours, zneighbours])
            candidates = neighbours[neighbours.functions == -1]
            acceptedCandidates = candidates[(candidates.shadowvalues <= maxShadowValueStarterhousing) & (candidates.noisevalues >= minNoiseValueStarterhousing)]
            mindist = 1000
            closestCandidate = firstStarterhousingIndex
            for k in acceptedCandidates.index.values:
                dist = np.sqrt((df.loc[k, 'x'] - df.loc[firstAtriumIndex, 'x'])**2 + (df.loc[k, 'y'] - df.loc[firstAtriumIndex, 'y'])**2)
                if dist < mindist:
                    mindist = dist
                    closestCandidate = k
            df.loc[closestCandidate, 'functions'] = 3
            countaccepted = countaccepted + len(acceptedCandidates)
        if countaccepted == 0:
            starterhousingFull = 1
            print('growing starterhousing was interrupted because no acceptable voxels found')
    if len(df[df.functions == 3]) >= maxSurfaceStarterhousing:
        starterhousingFull = 1


    if (len(df[df.functions == 4])/2) < maxSurfaceWorkspace:
        countaccepted = 0
        workspacePoints = df[df.functions == 4]
        workspaceIndices = workspacePoints.index[workspacePoints.z == 0].values
        for i in workspaceIndices: 
            xneighbours = df[((df.x == (df.loc[i, 'x'] + 1)) | (df.x == (df.loc[i, 'x'] - 1))) & (df.y == (df.loc[i, 'y'])) & (df.z == (df.loc[i, 'z']))]
            yneighbours = df[((df.y == (df.loc[i, 'y'] + 1)) | (df.y == (df.loc[i, 'y'] - 1))) & (df.x == (df.loc[i, 'x'])) & (df.z == (df.loc[i, 'z']))]
            neighbours = pd.concat([xneighbours, yneighbours])
            candidates = neighbours[neighbours.functions == -1]
            acceptedCandidates = candidates[(candidates.shadowvalues <= maxShadowValueWorkspace) & (candidates.noisevalues >= minNoiseValueWorkspace)]
            mindist_a = 1000
            closestCandidate_a = firstWorkspaceIndex
            #select the point that is closest to the edge of the building where there is more sunlight
            mindist_e = 1000
            closestCandidate_e = firstWorkspaceIndex
            mindist_e2 = 1000
            closestCandidate_e2 = firstWorkspaceIndex
            for k in acceptedCandidates.index.values:
                #dist_a = np.sqrt((df.loc[k, 'x'] - df.loc[firstAtriumIndex, 'x'])**2 + (df.loc[k, 'y'] - df.loc[firstAtriumIndex, 'y'])**2)
                #if dist_a < mindist_a:
                    #mindist_a = dist_a
                    #closestCandidate_a = k
                #dist_e = df.loc[k, 'x']
                #if dist_e < mindist_e:
                    #mindist_e = dist_e
                    #closestCandidate_e = k
                dist_e2 = 18 - df.loc[k, 'y']
                if dist_e2 < mindist_e2:
                    mindist_e2 = dist_e2
                    closestCandidate_e2 = k
            df.loc[[closestCandidate_a, closestCandidate_e, closestCandidate_e2], 'functions'] = 4
            for j in [closestCandidate_a, closestCandidate_e, closestCandidate_e2]:
                closestCandidate_z = df[(df.x == df.loc[j, 'x']) & (df.y == df.loc[j, 'y']) & (df.z == (df.loc[j, 'z']+1))]
                df.loc[closestCandidate_z.index.values, 'functions'] = 4
            countaccepted = countaccepted + len(acceptedCandidates)
        if countaccepted == 0:
            workspaceFull = 1
            print('growing workspace was interrupted because no acceptable voxels found')
    if (len(df[df.functions == 4])/2) >= maxSurfaceWorkspace:
        workspaceFull = 1


    if (len(df[df.functions == 5])/2) < maxSurfaceRestaurant:
        countaccepted = 0
        restaurantPoints = df[df.functions == 5]
        restaurantIndices = restaurantPoints.index[restaurantPoints.z == 0].values
        for i in restaurantIndices: 
            xneighbours = df[((df.x == (df.loc[i, 'x'] + 1)) | (df.x == (df.loc[i, 'x'] - 1))) & (df.y == (df.loc[i, 'y'])) & (df.z == (df.loc[i, 'z']))]
            yneighbours = df[((df.y == (df.loc[i, 'y'] + 1)) | (df.y == (df.loc[i, 'y'] - 1))) & (df.x == (df.loc[i, 'x'])) & (df.z == (df.loc[i, 'z']))]
            neighbours = pd.concat([xneighbours, yneighbours])
            candidates = neighbours[neighbours.functions == -1]
            acceptedCandidates = candidates[(candidates.shadowvalues <= maxShadowValueRestaurant) & (candidates.noisevalues >= minNoiseValueRestaurant)]
            mindist = 1000
            closestCandidate = firstRestaurantIndex
            for k in acceptedCandidates.index.values:
                dist = np.sqrt((df.loc[k, 'x'] - df.loc[firstAtriumIndex, 'x'])**2 + (df.loc[k, 'y'] - df.loc[firstAtriumIndex, 'y'])**2)
                if dist < mindist:
                    mindist = dist
                    closestCandidate = k
            df.loc[closestCandidate, 'functions'] = 5
            closestCandidate_z = df[(df.x == df.loc[closestCandidate, 'x']) & (df.y == df.loc[closestCandidate, 'y']) & (df.z == (df.loc[closestCandidate, 'z']+1))]
            df.loc[closestCandidate_z.index.values, 'functions'] = 5
            countaccepted = countaccepted + len(acceptedCandidates)
        if countaccepted == 0:
            restaurantFull = 1
            print('growing restaurant was interrupted because no acceptable voxels found')
    if (len(df[df.functions == 5])/2) >= maxSurfaceRestaurant:
        restaurantFull = 1


    if (len(df[df.functions == 6])/2) < maxSurfaceCinema:
        countaccepted = 0
        cinemaPoints = df[df.functions == 6]
        cinemaIndices = cinemaPoints.index[cinemaPoints.z == 0].values
        for i in cinemaIndices: 
            xneighbours = df[((df.x == (df.loc[i, 'x'] + 1)) | (df.x == (df.loc[i, 'x'] - 1))) & (df.y == (df.loc[i, 'y'])) & (df.z == (df.loc[i, 'z']))]
            yneighbours = df[((df.y == (df.loc[i, 'y'] + 1)) | (df.y == (df.loc[i, 'y'] - 1))) & (df.x == (df.loc[i, 'x'])) & (df.z == (df.loc[i, 'z']))]
            neighbours = pd.concat([xneighbours, yneighbours])
            candidates = neighbours[neighbours.functions == -1]
            acceptedCandidates = candidates[(candidates.shadowvalues <= maxShadowValueCinema) & (candidates.noisevalues >= minNoiseValueCinema)]
            mindist = 1000
            closestCandidate = firstCinemaIndex
            for k in acceptedCandidates.index.values:
                dist = np.sqrt((df.loc[k, 'x'] - df.loc[firstAtriumIndex, 'x'])**2 + (df.loc[k, 'y'] - df.loc[firstAtriumIndex, 'y'])**2)
                if dist < mindist:
                    mindist = dist
                    closestCandidate = k
            df.loc[closestCandidate, 'functions'] = 6
            closestCandidate_z = df[(df.x == df.loc[closestCandidate, 'x']) & (df.y == df.loc[closestCandidate, 'y']) & (df.z == (df.loc[closestCandidate, 'z']+1))]
            df.loc[closestCandidate_z.index.values, 'functions'] = 6
            countaccepted = countaccepted + len(acceptedCandidates)
        if countaccepted == 0:
            cinemaFull = 1
            print('growing cinema was interrupted because no acceptable voxels found')
    if (len(df[df.functions == 6])/2) >= maxSurfaceCinema:
        cinemaFull = 1


    if (len(df[df.functions == 7])/2) < maxSurfaceGym:
        countaccepted = 0
        gymPoints = df[df.functions == 7]
        gymIndices = gymPoints.index[gymPoints.z == 0].values
        for i in gymIndices:  
            xneighbours = df[((df.x == (df.loc[i, 'x'] + 1)) | (df.x == (df.loc[i, 'x'] - 1))) & (df.y == (df.loc[i, 'y'])) & (df.z == (df.loc[i, 'z']))]
            yneighbours = df[((df.y == (df.loc[i, 'y'] + 1)) | (df.y == (df.loc[i, 'y'] - 1))) & (df.x == (df.loc[i, 'x'])) & (df.z == (df.loc[i, 'z']))]
            neighbours = pd.concat([xneighbours, yneighbours])
            candidates = neighbours[neighbours.functions == -1]
            acceptedCandidates = candidates[(candidates.shadowvalues <= maxShadowValueGym) & (candidates.noisevalues >= minNoiseValueGym)]
            mindist = 1000
            closestCandidate = firstGymIndex
            for k in acceptedCandidates.index.values:
                dist = np.sqrt((df.loc[k, 'x'] - df.loc[firstAtriumIndex, 'x'])**2 + (df.loc[k, 'y'] - df.loc[firstAtriumIndex, 'y'])**2)
                if dist < mindist:
                    mindist = dist
                    closestCandidate = k
            df.loc[closestCandidate, 'functions'] = 7
            closestCandidate_z = df[(df.x == df.loc[closestCandidate, 'x']) & (df.y == df.loc[closestCandidate, 'y']) & (df.z == (df.loc[closestCandidate, 'z']+1))]
            df.loc[closestCandidate_z.index.values, 'functions'] = 7
            countaccepted = countaccepted + len(acceptedCandidates)
        if countaccepted == 0:
            gymFull = 1
            print('growing gym was interrupted because no acceptable voxels found')
    if (len(df[df.functions == 7])/2) >= maxSurfaceGym:
        gymFull = 1


    if (len(df[df.functions == 8])/2) < maxSurfaceSupermarket:
        countaccepted = 0
        supermarketPoints = df[df.functions == 8]
        supermarketIndices = supermarketPoints.index[supermarketPoints.z == 0].values
        for i in supermarketIndices:
            xneighbours = df[((df.x == (df.loc[i, 'x'] + 1)) | (df.x == (df.loc[i, 'x'] - 1))) & (df.y == (df.loc[i, 'y'])) & (df.z == (df.loc[i, 'z']))]
            yneighbours = df[((df.y == (df.loc[i, 'y'] + 1)) | (df.y == (df.loc[i, 'y'] - 1))) & (df.x == (df.loc[i, 'x'])) & (df.z == (df.loc[i, 'z']))]
            neighbours = pd.concat([xneighbours, yneighbours])
            candidates = neighbours[neighbours.functions == -1]
            acceptedCandidates = candidates[(candidates.shadowvalues <= maxShadowValueSupermarket) & (candidates.noisevalues >= minNoiseValueSupermarket)]
            mindist = 1000
            closestCandidate = firstSupermarketIndex
            for k in acceptedCandidates.index.values:
                dist = np.sqrt((df.loc[k, 'x'] - df.loc[firstAtriumIndex, 'x'])**2 + (df.loc[k, 'y'] - df.loc[firstAtriumIndex, 'y'])**2)
                if dist < mindist:
                    mindist = dist
                    closestCandidate = k
            df.loc[closestCandidate, 'functions'] = 8
            closestCandidate_z = df[(df.x == df.loc[closestCandidate, 'x']) & (df.y == df.loc[closestCandidate, 'y']) & (df.z == (df.loc[closestCandidate, 'z']+1))]
            df.loc[closestCandidate_z.index.values, 'functions'] = 8
            countaccepted = countaccepted + len(acceptedCandidates)
        if countaccepted == 0:
            supermarketFull = 1
            print('growing supermarket was interrupted because no acceptable voxels found')
    if (len(df[df.functions == 8])/2) >= maxSurfaceSupermarket:
        supermarketFull = 1

    counter = len(df[df.functions != -1]) #checks if there are still availbale points in the pointcloud

#deleting the atrium points above 4 floors as the functions around it don't grow above this level
indices = df.index[(df.functions == 0) & (df.z > 3)].values
df.loc[indices, 'functions'] = -1

#creating lists of the indexnumbers of the points in each function
indicesAtrium = []
indicesStudenthousing = []
indicesAssistedhousing = []
indicesStarterhousing = []
indicesWorkspacefunctions = []
indicesRestaurantfunctions = []
indicesCinemafunctions = []
indicesGymfunctions = []
indicesSupermarketfunctions = []

for i in df.index[df.functions == 0].values:
    indicesAtrium.append(i)
for i in df.index[df.functions == 1].values:
    indicesStudenthousing.append(i)
for i in df.index[df.functions == 2].values:
    indicesAssistedhousing.append(i)
for i in df.index[df.functions == 3].values:
    indicesStarterhousing.append(i)
for i in df.index[df.functions == 4].values:
    indicesWorkspacefunctions.append(i)
for i in df.index[df.functions == 5].values:
    indicesRestaurantfunctions.append(i)
for i in df.index[df.functions == 6].values:
    indicesCinemafunctions.append(i)
for i in df.index[df.functions == 7].values:
    indicesGymfunctions.append(i)
for i in df.index[df.functions == 8].values:
    indicesSupermarketfunctions.append(i)
# ---------- end growing_algorithm ----------
panel_10 = Panel(growing_algorithm.output)  # disabled
item_8 = ListItem(List=pt_16, Index=growing_algorithm.indicesStudenthousing, Wrap=True)  # disabled
item_9 = ListItem(List=pt_16, Index=growing_algorithm.indicesStarterhousing, Wrap=True)  # disabled
item_10 = ListItem(List=pt_16, Index=growing_algorithm.indicesRestaurantfunctions, Wrap=True)  # disabled
item_11 = ListItem(List=pt_16, Index=growing_algorithm.indicesGymfunctions, Wrap=True)  # disabled
item_12 = ListItem(List=pt_16, Index=growing_algorithm.indicesAtrium, Wrap=True)  # disabled
item_13 = ListItem(List=pt_16, Index=growing_algorithm.indicesAssistedhousing, Wrap=True)  # disabled
item_14 = ListItem(List=pt_16, Index=growing_algorithm.indicesWorkspacefunctions, Wrap=True)  # disabled
item_15 = ListItem(List=pt_16, Index=growing_algorithm.indicesCinemafunctions, Wrap=True)  # disabled
item_16 = ListItem(List=pt_16, Index=growing_algorithm.indicesSupermarketfunctions, Wrap=True)  # disabled

# ---- group: Filter
# Filter: Used to viualize which points have an attribute value lower than a certain threshold
threshold = Slider(0.4, range=0..1)  # disabled
smaller = SmallerThan(FirstNumber=num_8, SecondNumber=threshold)  # -> SmallerThan, OrEqualTo; disabled
dispatch = Dispatch(List=pt_15, DispatchPattern=smaller.SmallerThan)  # -> ListA, ListB; disabled
pt_17 = Point(dispatch.ListA)  # disabled

# ---- group: Colours
bnd_2 = Bounds(Numbers=num_7)  # disabled
dedomain_2 = DeconstructDomain(Domain=bnd_2)  # -> Start, End; disabled
gradient_2 = Gradient(
    LowerLimit=dedomain_2.Start,
    UpperLimit=dedomain_2.End,
    Parameter=num_7,
    stops=[0: RGB(234, 38, 0), 0.25: RGB(234, 126, 0), 0.5: RGB(254, 244, 84), 0.75: RGB(173, 203, 249), 1: RGB(75, 107, 169)])  # disabled
material_2 = CreateMaterial(Diffuse=gradient_2, Specular=RGB(255, 255, 255), Emission=RGB(0, 0, 0), Transparency=0, Shine=0)  # disabled
preview_2 = CustomPreview(Geometry=pt_15, Material=material_2)  # disabled

# ---- group: Visualization
num_9 = Number(expr("x/2", z_size_small))  # disabled
num_10 = Number(expr("x/2", x_size_small))  # disabled
box = CenterBox(Base=item_12, X=num_10, Y=num_10, Z=num_9)  # disabled
box_2 = CenterBox(Base=item_8, X=num_10, Y=num_10, Z=num_9)  # disabled
box_3 = CenterBox(Base=item_13, X=num_10, Y=num_10, Z=num_9)  # disabled
box_4 = CenterBox(Base=item_9, X=num_10, Y=num_10, Z=num_9)  # disabled
box_5 = CenterBox(Base=item_14, X=num_10, Y=num_10, Z=num_9)  # disabled
box_6 = CenterBox(Base=item_10, X=num_10, Y=num_10, Z=num_9)  # disabled
box_7 = CenterBox(Base=item_15, X=num_10, Y=num_10, Z=num_9)  # disabled
box_8 = CenterBox(Base=item_11, X=num_10, Y=num_10, Z=num_9)  # disabled
box_9 = CenterBox(Base=item_16, X=num_10, Y=num_10, Z=num_9)  # disabled
mesh_4 = MeshBrep(
    Brep=box,
    Settings={GridMaxCount=0, GridMinCount=16, JaggedSeams=False, MaxEdgeLength=0, MinEdgeLength=0.0001, MinTolerance=0, Refine=True, RefineAngle=0, RelativeTolerance=0.65, SimplePlanes=True, Tolerance=0})  # disabled
mesh_5 = MeshBrep(
    Brep=box_2,
    Settings={GridMaxCount=0, GridMinCount=16, JaggedSeams=False, MaxEdgeLength=0, MinEdgeLength=0.0001, MinTolerance=0, Refine=True, RefineAngle=0, RelativeTolerance=0.65, SimplePlanes=True, Tolerance=0})  # disabled
mesh_6 = MeshBrep(
    Brep=box_3,
    Settings={GridMaxCount=0, GridMinCount=16, JaggedSeams=False, MaxEdgeLength=0, MinEdgeLength=0.0001, MinTolerance=0, Refine=True, RefineAngle=0, RelativeTolerance=0.65, SimplePlanes=True, Tolerance=0})  # disabled
mesh_7 = MeshBrep(
    Brep=box_4,
    Settings={GridMaxCount=0, GridMinCount=16, JaggedSeams=False, MaxEdgeLength=0, MinEdgeLength=0.0001, MinTolerance=0, Refine=True, RefineAngle=0, RelativeTolerance=0.65, SimplePlanes=True, Tolerance=0})  # disabled
mesh_8 = MeshBrep(
    Brep=box_5,
    Settings={GridMaxCount=0, GridMinCount=16, JaggedSeams=False, MaxEdgeLength=0, MinEdgeLength=0.0001, MinTolerance=0, Refine=True, RefineAngle=0, RelativeTolerance=0.65, SimplePlanes=True, Tolerance=0})  # disabled
mesh_9 = MeshBrep(
    Brep=box_6,
    Settings={GridMaxCount=0, GridMinCount=16, JaggedSeams=False, MaxEdgeLength=0, MinEdgeLength=0.0001, MinTolerance=0, Refine=True, RefineAngle=0, RelativeTolerance=0.65, SimplePlanes=True, Tolerance=0})  # disabled
mesh_10 = MeshBrep(
    Brep=box_7,
    Settings={GridMaxCount=0, GridMinCount=16, JaggedSeams=False, MaxEdgeLength=0, MinEdgeLength=0.0001, MinTolerance=0, Refine=True, RefineAngle=0, RelativeTolerance=0.65, SimplePlanes=True, Tolerance=0})  # disabled
mesh_11 = MeshBrep(
    Brep=box_8,
    Settings={GridMaxCount=0, GridMinCount=16, JaggedSeams=False, MaxEdgeLength=0, MinEdgeLength=0.0001, MinTolerance=0, Refine=True, RefineAngle=0, RelativeTolerance=0.65, SimplePlanes=True, Tolerance=0})  # disabled
mesh_12 = MeshBrep(
    Brep=box_9,
    Settings={GridMaxCount=0, GridMinCount=16, JaggedSeams=False, MaxEdgeLength=0, MinEdgeLength=0.0001, MinTolerance=0, Refine=True, RefineAngle=0, RelativeTolerance=0.65, SimplePlanes=True, Tolerance=0})  # disabled
swatch = ColourSwatch(SwatchColor=RGB(235, 157, 198))  # disabled
swatch_2 = ColourSwatch(SwatchColor=RGB(10, 163, 48))  # disabled
swatch_3 = ColourSwatch(SwatchColor=RGB(30, 37, 250))  # disabled
swatch_4 = ColourSwatch(SwatchColor=RGB(250, 158, 30))  # disabled
swatch_5 = ColourSwatch(SwatchColor=RGB(250, 30, 30))  # disabled
swatch_6 = ColourSwatch(SwatchColor=RGB(235, 250, 30))  # disabled
swatch_7 = ColourSwatch(SwatchColor=RGB(222, 9, 190))  # disabled
swatch_8 = ColourSwatch(SwatchColor=RGB(154, 85, 237))  # disabled
swatch_9 = ColourSwatch(SwatchColor=RGB(30, 228, 250))  # disabled
c_script = CSharpScript(M=mesh_4, C=swatch_5)  # -> out, A; inputs M: Mesh; disabled
# ---------- c_script: C# ----------
    System.Drawing.Color Col = (System.Drawing.Color) C;
    M.VertexColors.CreateMonotoneMesh(Col);
    A = M;
# ---------- end c_script ----------
c_script_2 = CSharpScript(M=mesh_5, C=swatch_6)  # -> out, A; inputs M: Mesh; disabled; same code as c_script
c_script_3 = CSharpScript(M=mesh_6, C=swatch)  # -> out, A; inputs M: Mesh; disabled; same code as c_script
c_script_4 = CSharpScript(M=mesh_7, C=swatch_7)  # -> out, A; inputs M: Mesh; disabled; same code as c_script
c_script_5 = CSharpScript(M=mesh_8, C=swatch_2)  # -> out, A; inputs M: Mesh; disabled; same code as c_script
c_script_6 = CSharpScript(M=mesh_9, C=swatch_3)  # -> out, A; inputs M: Mesh; disabled; same code as c_script
c_script_7 = CSharpScript(M=mesh_10, C=swatch_8)  # -> out, A; inputs M: Mesh; disabled; same code as c_script
c_script_8 = CSharpScript(M=mesh_11, C=swatch_9)  # -> out, A; inputs M: Mesh; disabled; same code as c_script
c_script_9 = CSharpScript(M=mesh_12, C=swatch_4)  # -> out, A; inputs M: Mesh; disabled; same code as c_script
panel_11 = Panel(c_script.out)  # disabled
panel_12 = Panel(c_script_2.out)  # disabled
panel_13 = Panel(c_script_3.out)  # disabled
panel_14 = Panel(c_script_5.out)  # disabled
panel_15 = Panel(c_script_6.out)  # disabled
panel_16 = Panel(c_script_7.out)  # disabled
panel_17 = Panel(c_script_8.out)  # disabled
panel_18 = Panel(c_script_9.out)  # disabled
panel_19 = Panel(c_script_4.out)  # disabled

# ---- group: Design
box_10 = CenterBox(Base=item_12, X=expr("x/2", x_size_small), Y=expr("x/2", y_size_small), Z=expr("x/2", z_size_small))  # disabled
box_11 = CenterBox(Base=item_8, X=expr("x/2", x_size_small), Y=expr("x/2", y_size_small), Z=expr("x/2", z_size_small))  # disabled
box_12 = CenterBox(Base=item_13, X=expr("x/2", x_size_small), Y=expr("x/2", y_size_small), Z=expr("x/2", z_size_small))  # disabled
box_13 = CenterBox(Base=item_9, X=expr("x/2", x_size_small), Y=expr("x/2", y_size_small), Z=expr("x/2", z_size_small))  # disabled
box_14 = CenterBox(Base=item_14, X=expr("x/2", x_size_small), Y=expr("x/2", y_size_small), Z=expr("x/2", z_size_small))  # disabled
box_15 = CenterBox(Base=item_10, X=expr("x/2", x_size_small), Y=expr("x/2", y_size_small), Z=expr("x/2", z_size_small))  # disabled
box_16 = CenterBox(Base=item_15, X=expr("x/2", x_size_small), Y=expr("x/2", y_size_small), Z=expr("x/2", z_size_small))  # disabled
box_17 = CenterBox(Base=item_11, X=expr("x/2", x_size_small), Y=expr("x/2", y_size_small), Z=expr("x/2", z_size_small))  # disabled
box_18 = CenterBox(Base=item_16, X=expr("x/2", x_size_small), Y=expr("x/2", y_size_small), Z=expr("x/2", z_size_small))  # disabled
atrium = Atrium(brep=box_10)  # disabled
student = Student(brep=box_11)  # disabled
assisted = Student(brep=box_12)  # disabled
starter = Student(brep=box_13)  # disabled
workspace = Student(brep=box_14)  # disabled
restaurant = Student(brep=box_15)  # disabled
cinema = Student(brep=box_16)  # disabled
gym = Student(brep=box_17)  # disabled
supermarket = Student(brep=box_18)  # disabled

# ---- group: Atrium frames
debrep = DeconstructBrep(Brep=atrium)  # -> Faces, Edges, Vertices; disabled
panel_20 = Panel("0.5,0.5")  # disabled
evalsrf = EvaluateSurface(Surface=debrep.Faces, Point=panel_20)  # -> Point, Normal, UDirection, VDirection, Frame; disabled
devec = DeconstructVector(Vector=evalsrf.Normal)  # -> XComponent, YComponent, ZComponent; disabled
panel_21 = Panel("1")  # disabled
equals = Equality(FirstNumber=devec.ZComponent, SecondNumber=panel_21)  # -> Equality, Inequality; disabled
dispatch_2 = Dispatch(List=debrep.Faces, DispatchPattern=equals.Equality)  # -> flatten(ListA), ListB; disabled
area = Area(Geometry=dispatch_2.ListA)  # -> Area, Centroid; disabled
larger = LargerThan(FirstNumber=area.Area, SecondNumber=80000000)  # -> LargerThan, OrEqualTo; disabled
center_to_center_distance = Panel("2000")  # disabled
cull = CullPattern(List=dispatch_2.ListA, CullPattern=larger.LargerThan)  # disabled
len = Length(Curve=cull)  # disabled
division_4 = Division(A=len, B=center_to_center_distance)  # disabled
item_17 = ListItem(List=cull, Index=1, Wrap=True)  # disabled
floor_height = Number(z_size_small)  # disabled
Z_4 = UnitZ(Factor=expr("x*-1", floor_height))  # disabled
sdivide = DivideSurface(Surface=item_17, UCount=30, VCount=7)  # -> Points, Normals, Parameters; disabled
divide_3 = DivideCurve(Curve=cull, Count=division_4, Kinks=False)  # -> Points, Tangents, Parameters; disabled
move = Move(Geometry=divide_3.Points, Motion=Z_4)  # -> Geometry, Transform; disabled
edges = BrepEdges(Brep=cull)  # -> Naked, Interior, NonManifold; disabled
iso = IsoCurve(Surface=item_17, UVPoint=sdivide.Parameters)  # -> UIsocurve, VIsocurve; disabled
ln_3 = Line(StartPoint=divide_3.Points, EndPoint=move.Geometry)  # disabled
# FORMING
frame_radius = Panel("50")  # disabled
pipe = Pipe(Curve=[iso.UIsocurve, iso.VIsocurve, ln_3, edges.Naked], Radius=frame_radius, Caps=0)  # disabled

# ----
merge_2 = Merge(
    Data2=student,
    Data3=assisted,
    Data4=starter,
    Data5=workspace,
    Data6=restaurant,
    Data7=cinema,
    Data8=gym,
    Data9=supermarket)  # disabled

# ---- group: Railing
debrep_2 = DeconstructBrep(Brep=merge_2)  # -> Faces, Edges, Vertices; disabled
panel_22 = Panel("0.5,0.5")  # disabled
evalsrf_2 = EvaluateSurface(Surface=debrep_2.Faces, Point=panel_22)  # -> Point, Normal, UDirection, VDirection, Frame; disabled
devec_2 = DeconstructVector(Vector=evalsrf_2.Normal)  # -> XComponent, YComponent, ZComponent; disabled
panel_23 = Panel("1")  # disabled
equals_2 = Equality(FirstNumber=devec_2.ZComponent, SecondNumber=panel_23)  # -> Equality, Inequality; disabled
dispatch_3 = Dispatch(List=debrep_2.Faces, DispatchPattern=equals_2.Equality)  # -> flatten(ListA), ListB; disabled
area_2 = Area(Geometry=dispatch_3.ListA)  # -> Area, Centroid; disabled
larger_2 = LargerThan(FirstNumber=area_2.Area, SecondNumber=80000000)  # -> LargerThan, OrEqualTo; disabled
cull_2 = CullPattern(List=dispatch_3.ListA, CullPattern=larger_2.LargerThan)  # disabled
panel_24 = Panel("10")  # disabled
edges_2 = BrepEdges(Brep=cull_2)  # -> Naked, Interior, NonManifold; disabled
Z_5 = UnitZ(Factor=panel_24)  # disabled
move_2 = Move(Geometry=edges_2.Naked, Motion=Z_5)  # -> Geometry, Transform; disabled
railing_height = Panel("1100")  # disabled
trim = TrimWithBreps(Curve=move_2.Geometry, Brep=[merge_2, cap_3])  # -> Inside, flatten(Outside); disabled
Z_6 = UnitZ(Factor=railing_height)  # disabled
move_3 = Move(Geometry=trim.Outside, Motion=Z_6)  # -> Geometry, Transform; disabled
distance_between_bars = Panel("4000")  # disabled
extr_5 = Extrude(Base=trim.Outside, Direction=Z_6)  # -> graft(Extrusion); disabled
rail_2 = Curve(move_3.Geometry)  # disabled
len_2 = Length(Curve=rail_2)  # disabled
division_5 = Division(A=len_2, B=distance_between_bars)  # disabled
divide_4 = DivideCurve(Curve=rail_2, Count=division_5, Kinks=False)  # -> Points, Tangents, Parameters; disabled
move_4 = Move(Geometry=divide_4.Points, Motion=expr("x*-1", Z_6))  # -> Geometry, Transform; disabled
bars = Line(StartPoint=divide_4.Points, EndPoint=move_4.Geometry)  # disabled
srfsplit = SurfaceSplit(Surface=extr_5, Curves=bars)  # disabled

# ---- group: window frames
edges_3 = BrepEdges(Brep=dispatch_3.ListA)  # -> Naked, Interior, NonManifold; disabled
window_width = Panel("1000")  # disabled
len_3 = Length(Curve=edges_3.Naked)  # disabled
window_height = Number(z_size_small)  # disabled
division_6 = Division(A=len_3, B=window_width)  # disabled
divide_5 = DivideCurve(Curve=edges_3.Naked, Count=division_6, Kinks=False)  # -> Points, Tangents, Parameters; disabled
Z_7 = UnitZ(Factor=expr("x*-1", window_height))  # disabled
move_5 = Move(Geometry=divide_5.Points, Motion=Z_7)  # -> Geometry, Transform; disabled
ln_4 = Line(StartPoint=divide_5.Points, EndPoint=move_5.Geometry)  # disabled

# ---- group: Floors
devec_3 = DeconstructVector(Vector=evalsrf_2.Normal)  # -> XComponent, YComponent, ZComponent; disabled
panel_25 = Panel("-1")  # disabled
equals_3 = Equality(FirstNumber=devec_3.ZComponent, SecondNumber=panel_25)  # -> Equality, Inequality; disabled
dispatch_4 = Dispatch(List=debrep_2.Faces, DispatchPattern=equals_3.Equality)  # -> flatten(ListA), ListB; disabled
area_3 = Area(Geometry=[dispatch_4.ListA, dispatch_3.ListA])  # -> Area, Centroid; disabled
floor_thickness = Panel("300")  # disabled
Z_8 = UnitZ(Factor=expr("x*-1", floor_thickness))  # disabled
scale_nu = ScaleNU(Geometry=[dispatch_4.ListA, dispatch_3.ListA], Plane=area_3.Centroid, ScaleX=1.05, ScaleY=1.05, ScaleZ=1)  # -> Geometry, Transform; disabled
extr_6 = Extrude(Base=scale_nu.Geometry, Direction=Z_8)  # disabled
cap_4 = CapHoles(Brep=extr_6)  # disabled

# ==== cluster Student
brep = ClusterInput()
brep_2 = Brep(brep)
volume = Volume(Geometry=brep_2)  # -> Volume, Centroid
pdecon = Deconstruct(Point=volume.Centroid)  # -> XComponent, YComponent, ZComponent
int = Integer(pdecon.ZComponent)
item = ListItem(List=int, Index=0, Wrap=True)
subtraction = Subtraction(A=pdecon.ZComponent, B=item)
panel = Panel(int)
splitting_functions_into_floors = GhPythonScript(AllPoints=brep_2, Distances=subtraction, Height="3240")  # -> out, bg, eerste, tweede, derde, vierde, vijfde, zesde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; inputs AllPoints: list of Brep, Distances: list, Height: Int32
# ---------- splitting_functions_into_floors: Python ----------
__author__ = "R_C_S"
__version__ = "2019.01.18"

import rhinoscriptsyntax as rs

bg = []
eerste = []
tweede = []
derde = []
vierde = []
vijfde = []
zesde = []
zevende = []
achtste = []
negende = []
tiende = []

HalfHeight = Height/2

for i in range(0,len(Distances)):
    if Distances[i] < HalfHeight:
        bg.append(AllPoints[i])
    if HalfHeight < Distances[i] < (Height + HalfHeight):
        eerste.append(AllPoints[i])
    if (Height + HalfHeight) < Distances[i] < (Height*2 + HalfHeight):
        tweede.append(AllPoints[i])
    if (Height*2 + HalfHeight) < Distances[i] < (Height*3 + HalfHeight):
        derde.append(AllPoints[i])
    if (Height*3 + HalfHeight) < Distances[i] < (Height*4 + HalfHeight):
        vierde.append(AllPoints[i])
    if (Height*4 + HalfHeight) < Distances[i] < (Height*5 + HalfHeight):
        vijfde.append(AllPoints[i])
    if (Height*5 + HalfHeight) < Distances[i] < (Height*6 + HalfHeight):
        zesde.append(AllPoints[i])
    if (Height*6 + HalfHeight) < Distances[i] < (Height*7 + HalfHeight):
        zevende.append(AllPoints[i])
    if (Height*7 + HalfHeight) < Distances[i] < (Height*8 + HalfHeight):
        achtste.append(AllPoints[i])
    if (Height*8 + HalfHeight) < Distances[i] < (Height*9 + HalfHeight):
        negende.append(AllPoints[i])
# ---------- end splitting_functions_into_floors ----------
cluster = Cluster(brep=splitting_functions_into_floors.bg)
cluster_2 = Cluster(brep=splitting_functions_into_floors.derde)
cluster_3 = Cluster(brep=splitting_functions_into_floors.zesde)
cluster_4 = Cluster(brep=splitting_functions_into_floors.eerste)
cluster_5 = Cluster(brep=splitting_functions_into_floors.vierde)
cluster_6 = Cluster(brep=splitting_functions_into_floors.zevende)
cluster_7 = Cluster(brep=splitting_functions_into_floors.tweede)
cluster_8 = Cluster(brep=splitting_functions_into_floors.vijfde)
cluster_9 = Cluster(brep=splitting_functions_into_floors.achtste)
merge = Merge(
    Data1=cluster,
    Data2=cluster_4,
    Data3=cluster_7,
    Data4=cluster_2,
    Data5=cluster_5,
    Data6=cluster_8,
    Data7=cluster_3,
    Data8=cluster_6,
    Data9=cluster_9)  # -> flatten(Result)
area = Area(Geometry=merge)  # -> Area, Centroid
larger = LargerThan(FirstNumber=area.Area, SecondNumber="13000000")  # -> LargerThan, OrEqualTo
cull = CullPattern(List=merge, CullPattern=larger.LargerThan)
Z = UnitZ(Factor="3240")
extr = Extrude(Base=cull, Direction=Z)
cap = CapHoles(Brep=extr)
join = BrepJoin(Breps=cap)  # -> Breps, Closed
brep_3 = ClusterOutput(join.Breps)

# ==== cluster Atrium
brep = ClusterInput()
brep_2 = Brep(brep)
volume = Volume(Geometry=brep_2)  # -> Volume, Centroid
pdecon = Deconstruct(Point=volume.Centroid)  # -> XComponent, YComponent, ZComponent
int = Integer(pdecon.ZComponent)
item = ListItem(List=int, Index=0, Wrap=True)
subtraction = Subtraction(A=pdecon.ZComponent, B=item)
panel = Panel(int)
python = GhPythonScript(AllPoints=brep_2, Distances=subtraction, Height="3240")  # -> out, bg, eerste, tweede, derde, vierde, vijfde, zesde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; inputs AllPoints: list of Brep, Distances: list, Height: Int32; same code as splitting_functions_into_floors
cluster = Cluster(brep=python.bg)
cluster_2 = Cluster(brep=python.derde)
cluster_3 = Cluster(brep=python.zesde)
cluster_4 = Cluster(brep=python.eerste)
cluster_5 = Cluster(brep=python.vierde)
cluster_6 = Cluster(brep=python.zevende)
cluster_7 = Cluster(brep=python.tweede)
cluster_8 = Cluster(brep=python.vijfde)
cluster_9 = Cluster(brep=python.achtste)
merge = Merge(Data1=cluster, Data2=cluster_4)  # -> flatten(Result)
area = Area(Geometry=merge)  # -> Area, Centroid
larger = LargerThan(FirstNumber=area.Area, SecondNumber="25000000")  # -> LargerThan, OrEqualTo
cull = CullPattern(List=merge, CullPattern=larger.LargerThan)
Z = UnitZ(Factor="3240")
extr = Extrude(Base=cull, Direction=Z)
cap = CapHoles(Brep=extr)
join = BrepJoin(Breps=cap)  # -> Breps, Closed
brep_3 = ClusterOutput(join.Breps)

# ==== cluster Graphmaker
points = ClusterInput()
points_2 = Point(points)
y_size = ClusterInput()
z_size = ClusterInput()
x_size = ClusterInput()
z_size_2 = Number(z_size)
y_size_2 = Number(y_size)
x_size_2 = Number(x_size)

# ---- group: all points
pdecon = Deconstruct(Point=points_2)  # -> XComponent, YComponent, ZComponent
sort = SortList(Keys=pdecon.ZComponent)  # -> Keys, ValuesA
sort_2 = SortList(Keys=pdecon.XComponent)  # -> Keys, ValuesA
sort_3 = SortList(Keys=pdecon.YComponent)  # -> Keys, ValuesA
item = ListItem(List=sort.Keys, Index=0, Wrap=True)
item_2 = ListItem(List=sort_2.Keys, Index=0, Wrap=True)
item_3 = ListItem(List=sort_3.Keys, Index=0, Wrap=True)
subtraction = Subtraction(A=pdecon.XComponent, B=item_2)
subtraction_2 = Subtraction(A=pdecon.YComponent, B=item_3)
subtraction_3 = Subtraction(A=pdecon.ZComponent, B=item)
int = Integer(subtraction)
int_2 = Integer(subtraction_2)
int_3 = Integer(subtraction_3)
division = Division(A=int, B=x_size_2)
division_2 = Division(A=int_2, B=y_size_2)
division_3 = Division(A=int_3, B=z_size_2)

# ----
y_grid = Number(division_2)
x_grid = Number(division)
z_grid = Number(division_3)
x_grid_2 = ClusterOutput(x_grid)
y_grid_2 = ClusterOutput(y_grid)
z_grid_2 = ClusterOutput(z_grid)

# ==== cluster Cluster
brep = ClusterInput()
brep_2 = Brep(brep)
volume = Volume(Geometry=brep_2)  # -> Volume, Centroid
sunion = SolidUnion(Breps=brep_2)
debrep = DeconstructBrep(Brep=sunion)  # -> flatten(Faces), Edges, Vertices
evalsrf = EvaluateSurface(Surface=debrep.Faces, Point="0.5,0.5")  # -> Point, Normal, UDirection, VDirection, Frame
devec = DeconstructVector(Vector=evalsrf.Normal)  # -> XComponent, YComponent, flatten(ZComponent)
equals = Equality(FirstNumber=devec.ZComponent, SecondNumber=-1)  # -> Equality, Inequality
cull = CullPattern(List=debrep.Faces, CullPattern=equals.Equality)
boundary = BoundarySurfaces(Edges=cull)
join = BrepJoin(Breps=boundary)  # -> Breps, Closed
pcen = PolygonCenter(Polyline=join.Breps)  # -> CenterV, CenterE, CenterA
scale = Scale(Geometry=join.Breps, Center=pcen.CenterE, Factor=1.01)  # -> Geometry, Transform
join_2 = BrepJoin(Breps=scale.Geometry)  # -> Breps, Closed
runion = RegionUnion(Curves=join_2.Breps)
len = Length(Curve=runion)
division = Division(A=len, B="4000")
int = Integer(division)
divide = DivideCurve(Curve=runion, Count=int, Kinks=False)  # -> Points, Tangents, Parameters
nurbs = NurbsCurve(Vertices=divide.Points, Degree=7, Periodic=True)  # -> Curve, Length, Domain
crv = Curve(nurbs.Curve)
crv_2 = ClusterOutput(crv)
